# Grasshopper definition sk8.gh (Grasshopper 1.0.7)
# plug-ins: tOpos, Kangaroo Components, Weaverbird, Kangaroo2 Components

brep = Brep(<brep referenced from the Rhino model>)
area = Area(Geometry=brep)  # -> Area, Centroid
mesh = Mesh(<mesh referenced from the Rhino model>)
subtraction = Subtraction(A=1, B=area.Area)
weaverbird_s_catmull_clark_subdivision = WeaverbirdsCatmullClarkSubdivision(MeshCurves=mesh, Level=Slider(2, range=0..10), SmoothNakedEdges=0)
addition = Addition(A=subtraction, B=1)
multiplication = Multiplication(A=Slider(1.2, range=0..10), B=addition)
surface = Surface([<surface referenced from the Rhino model> x7])
flip = Flip(Surface=surface)  # -> Surface, Result
boundary_domain = BoundaryDomain(
    DomainMesh=weaverbird_s_catmull_clark_subdivision,
    DensityValue=1,
    YoungModul=Slider(140, range=0..200),
    PoissonNumber=Slider(0.34, range=0..1))
surface_load = SurfaceLoad(LoadSurface=flip.Surface, LoadValue=multiplication)
brep_2 = Brep([<brep referenced from the Rhino model> x2])
boundary_conditions = BoundaryConditions(Load=surface_load, Support=brep_2)
optimius_parameters = OptimiusParameters(
    OptimisationIteration=Slider(500, range=0..1000),
    VolumeFraction=Slider(0.05, range=0..1),
    Penalty=Domain(2, 3),
    Change=0.0005,
    SensitivityFilterRadius=Domain(1.5, 1.5),
    DensityFilterType=0,
    GrayScaleFilter=False,
    HeavisideProjection=0,
    SensitivityFilterType=0)
analyser_parameters = AnalyserParameters(Iterations=Slider(5000, range=0..10000), Tolerance=Slider(0.0001, range=0.0001..0.001))
resolution = Resolution(Size=Slider(0.004, range=0.001..0.08), sizeModeToggle=True)
model = Model(BoundaryDomain=boundary_domain, BoundaryCondition=boundary_conditions, ModelResolution=resolution, gpuModeToggle=True)  # -> Model, Performance
optimus = Optimus(
    Model=model.Model,
    AnalyserParameters=analyser_parameters,
    OptimusParameters=optimius_parameters,
    SubdivisionThreshold=Slider(0.5, range=0..1),
    Reset=Button(),
    Run=Toggle(False),
    optimisationPreviewMode=True,
    solverType=2)  # -> Model, Compliance, Performance
number_slider = Slider(0.035, range=0.0001..1)
data_dam = DataDam(DataDataA=optimus.Model, BufferDelay=10000000, BufferMode=0)
iso_mesh = IsoMesh(Model=data_dam, IsoValue=number_slider, Deflection=0)
combine_clean = CombineClean(Meshes=iso_mesh)
voxel_mesh = VoxelMesh(Model=data_dam, Threshold=number_slider, asOneMeshMode=True, densityPreviewMode=False)
deconstruct_mesh = DeconstructMesh(Mesh=combine_clean)  # -> Vertices, Faces, Colours, Normals
construct_mesh = ConstructMesh(Vertices=deconstruct_mesh.Vertices, Faces=deconstruct_mesh.Faces)
combine_clean_2 = CombineClean(Meshes=construct_mesh)
mesh_2 = Mesh(<mesh referenced from the Rhino model>)
weaverbird_s_catmull_clark_subdivision_2 = WeaverbirdsCatmullClarkSubdivision(MeshCurves=mesh_2, Level=Slider(3, range=0..10), SmoothNakedEdges=1)
smooth_mesh = SmoothMesh(Mesh=combine_clean_2, Strength=0.5, SkipNaked=True, Iterations=Slider(3, range=0..10))
mesh_3 = Mesh(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)
