# Grasshopper definition studio1.gh (Grasshopper 1.0.7)
# plug-ins: MetaHopper, Wombat

swatch = ColourSwatch(SwatchColor=RGB(255, 255, 255))

# ---- group: CTRL CENTRE
anz_elemente_in_x = Slider(5, range=1..20)
deg_rotation_cutout_profile = Slider(0, range=0..90)
axabstand_x = Slider(18, range=1..20)
axabstand_y = Slider(10, range=1..20)
anz_elemente_in_y = Slider(5, range=1..20)
cutout_profile_curve = Curve(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)
scale_of_cutout = Slider(2.4, range=0.01..5)

# ----
groups = GetGroups()  # -> Groups, GroupStyles, Nickname, Color
setgroup = SetGroupProperties(Group=groups.Groups, Color=ColourSwatch(SwatchColor=RGB(176, 176, 176)))

canvas_color = CanvasColor(Toggle=Toggle(True), BackgroundColor=swatch, GridColor=swatch)

# ---- group: cutout profile manipulation before placement
bbox = BoundingBox(Content=cutout_profile_curve, Plane=PlaneXY(0, 0, 0))  # -> Box, Box_2
boxprop = BoxProperties(Box=bbox.Box)  # -> Center, Diagonal, Area, Volume, Degeneracy
rad = Radians(Degrees=deg_rotation_cutout_profile)
rotate = Rotate(Geometry=cutout_profile_curve, Angle=rad, Plane=boxprop.Center)  # -> Geometry, Transform
scale = Scale(Geometry=rotate.Geometry, Center=boxprop.Center, Factor=scale_of_cutout)  # -> Geometry, Transform

# ---- group: stuetzenraster
panel = Panel("18")
panel_2 = Panel("10")
pt = ConstructPoint(XCoordinate=axabstand_x, YCoordinate=axabstand_y, ZCoordinate=0)
pt_2 = ConstructPoint(XCoordinate=axabstand_x, YCoordinate="0", ZCoordinate=0)
pt_3 = ConstructPoint(XCoordinate="0", YCoordinate="0", ZCoordinate=0)
pt_4 = ConstructPoint(XCoordinate="0", YCoordinate=axabstand_y, ZCoordinate=0)

# ---- group: X-centerpoints in yaxix
subtraction = Subtraction(A=anz_elemente_in_y, B="1")
ln = Line(StartPoint=pt_3, EndPoint=pt_4)
divide = DivideCurve(Curve=ln, Count=subtraction, Kinks=False)  # -> Points, Tangents, Parameters
partition = PartitionList(List=divide.Points, Size=subtraction)

# ---- group: X-centerpoints in xaxix
subtraction_2 = Subtraction(A=anz_elemente_in_x, B="1")
ln_2 = Line(StartPoint=pt_3, EndPoint=pt_2)
divide_2 = DivideCurve(Curve=ln_2, Count=subtraction_2, Kinks=False)  # -> Points, Tangents, Parameters
partition_2 = PartitionList(List=divide_2.Points, Size=subtraction_2)

# ---- group: helpstuff
ln_3 = Line(StartPoint=pt_2, EndPoint=pt_4)
ln_4 = Line(StartPoint=pt_3, EndPoint=pt)

# ---- group: cutout profile center points in yaxis
item = ListItem(List=divide.Points, Index=0, Wrap=True)
item_2 = ListItem(List=divide.Points, Index=1, Wrap=True)
dist = Distance(PointA=item, PointB=item_2)
division = Division(A=dist, B=2)
branch = TreeBranch(Tree=partition, Path="{0;0;0}", MaintainPaths=True)  # -> flatten(Branch)
Y = UnitY(Factor=division)
move = Move(Geometry=branch, Motion=Y)  # -> Geometry, Transform

# ---- group: main y axis profiles
vec2pt = Vector2Pt(PointA=boxprop.Center, PointB=move.Geometry, Unitize=False)  # -> Vector, Length
move_2 = Move(Geometry=scale.Geometry, Motion=vec2pt.Vector)  # -> Geometry, Transform

# ---- group: replication in x
_1st_item = ListItem(List=flatten(partition_2), Index=1, Wrap=True)
zero_item = ListItem(List=move.Geometry, Index=0, Wrap=True)
box = Box2Pt(PointA=zero_item, PointB=_1st_item, Plane=PlaneXY(0, 0, 0))
arrrec = RectangularArray(Geometry=move_2.Geometry, Cell=box, XCount=anz_elemente_in_x, YCount=1)  # -> Geometry, Transform

# ---- group: top curve at 0.00
item_3 = ListItem(List=move_2.Geometry, Index=0, Wrap=True)
bbox_2 = BoundingBox(Content=item_3, Plane=PlaneXY(0, 0, 0))  # -> Box, Box_2
boxprop_2 = BoxProperties(Box=bbox_2.Box)  # -> Center, Diagonal, Area, Volume, Degeneracy
scale_2 = Scale(Geometry=item_3, Center=boxprop_2.Center, Factor=Slider(1, range=0..1))  # -> Geometry, Transform

# ---- group: 2nd curve down
height = Slider(0, range=-1..1)
scale_3 = Slider(0.65, range=0..1)
Z = UnitZ(Factor=height)
neg = Negative(Value=Z)
move_3 = Move(Geometry=item_3, Motion=neg)  # -> Geometry, Transform
bbox_3 = BoundingBox(Content=move_3.Geometry, Plane=PlaneXY(0, 0, 0))  # -> Box, Box_2
boxprop_3 = BoxProperties(Box=bbox_3.Box)  # -> Center, Diagonal, Area, Volume, Degeneracy
scale_4 = Scale(Geometry=move_3.Geometry, Center=boxprop_3.Center, Factor=scale_3)  # -> Geometry, Transform

# ---- group: 3rd curve down
height_2 = Slider(0.2, range=0..1)
scale_5 = Slider(0.65, range=0..1)
Z_2 = UnitZ(Factor=height_2)
neg_2 = Negative(Value=Z_2)
move_4 = Move(Geometry=move_3.Geometry, Motion=neg_2)  # -> Geometry, Transform
bbox_4 = BoundingBox(Content=move_4.Geometry, Plane=PlaneXY(0, 0, 0))  # -> Box, Box_2
boxprop_4 = BoxProperties(Box=bbox_4.Box)  # -> Center, Diagonal, Area, Volume, Degeneracy
scale_6 = Scale(Geometry=move_4.Geometry, Center=boxprop_4.Center, Factor=scale_5)  # -> Geometry, Transform

# ---- group: 1st curve down
height_3 = Slider(0.25, range=0..1)
scale_7 = Slider(0.85, range=0..1)
Z_3 = UnitZ(Factor=height_3)
neg_3 = Negative(Value=Z_3)
move_5 = Move(Geometry=move_4.Geometry, Motion=neg_3)  # -> Geometry, Transform
bbox_5 = BoundingBox(Content=move_5.Geometry, Plane=PlaneXY(0, 0, 0))  # -> Box, Box_2
boxprop_5 = BoxProperties(Box=bbox_5.Box)  # -> Center, Diagonal, Area, Volume, Degeneracy
scale_8 = Scale(Geometry=move_5.Geometry, Center=boxprop_5.Center, Factor=scale_7)  # -> Geometry, Transform

height_4 = Slider(0.35, range=0..1)
scale_9 = Slider(1, range=0..1)
Z_4 = UnitZ(Factor=height_4)
neg_4 = Negative(Value=Z_4)
move_6 = Move(Geometry=move_5.Geometry, Motion=neg_4)  # -> Geometry, Transform
bbox_6 = BoundingBox(Content=move_6.Geometry, Plane=PlaneXY(0, 0, 0))  # -> Box, Box_2
boxprop_6 = BoxProperties(Box=bbox_6.Box)  # -> Center, Diagonal, Area, Volume, Degeneracy
scale_10 = Scale(Geometry=move_6.Geometry, Center=boxprop_6.Center, Factor=scale_9)  # -> Geometry, Transform

# ----
debox = DeconstructBox(Box=box)  # -> Plane, X, flatten(Y), Z
loft_opt = LoftOptions(Closed=False, Adjust=False, Rebuild=0, Refit=0, Type=0)
loft_opt_2 = LoftOptions(Closed=False, Adjust=False, Rebuild=0, Refit=0, Type=0)
loft_opt_3 = LoftOptions(Closed=False, Adjust=False, Rebuild=0, Refit=0, Type=0)
loft = Loft(Curves=[scale_4.Geometry, scale_6.Geometry], Options=loft_opt)
loft_2 = Loft(Curves=[scale_2.Geometry, scale_4.Geometry], Options=loft_opt_3)
loft_3 = Loft(Curves=[scale_6.Geometry, scale_8.Geometry, scale_10.Geometry], Options=loft_opt_2)

X = UnitX(Factor=axabstand_x)
Y_2 = UnitY(Factor=axabstand_y)
move_7 = Move(Geometry=divide.Points, Motion=X)  # -> Geometry, Transform
move_8 = Move(Geometry=divide_2.Points, Motion=Y_2)  # -> Geometry, Transform
shift = ShiftList(List=move_7.Geometry, Shift=Slider(-5, range=-7..7), Wrap=True)
shift_2 = ShiftList(List=divide.Points, Shift=Slider(5, range=-7..7), Wrap=True)
ln_5 = Line(StartPoint=move_8.Geometry, EndPoint=reverse(shift_2))
ln_6 = Line(StartPoint=move_8.Geometry, EndPoint=move_7.Geometry)
ln_7 = Line(StartPoint=divide_2.Points, EndPoint=divide.Points)

# ---- group: cutout profile center points in xaxis
item_4 = ListItem(List=divide_2.Points, Index=0, Wrap=True)
item_5 = ListItem(List=divide_2.Points, Index=1, Wrap=True)
dist_2 = Distance(PointA=item_4, PointB=item_5)
division_2 = Division(A=dist_2, B=2)
branch_2 = TreeBranch(Tree=partition_2, Path="{0;0;0}", MaintainPaths=True)  # -> flatten(Branch)

# ----
X_2 = UnitX(Factor=division_2)

# ---- group: cutout profile center points in xaxis (continued)
move_9 = Move(Geometry=branch_2, Motion=X_2)  # -> Geometry, Transform

# ----
ln_8 = Line(StartPoint=[divide_2.Points, move_9.Geometry], EndPoint=reverse(shift))

# ---- group: main x axis profiles
vec2pt_2 = Vector2Pt(PointA=boxprop.Center, PointB=move_9.Geometry, Unitize=False)  # -> Vector, Length
move_10 = Move(Geometry=scale.Geometry, Motion=vec2pt_2.Vector)  # -> Geometry, Transform

# ---- group: replication in y
_2nd_item = ListItem(List=flatten(move_9.Geometry), Index=0, Wrap=True)
_1st_item_2 = ListItem(List=branch, Index=1, Wrap=True)
box_2 = Box2Pt(PointA=_1st_item_2, PointB=_2nd_item, Plane=PlaneXY(0, 0, 0))
arrrec_2 = RectangularArray(Geometry=move_10.Geometry, Cell=box_2, XCount=1, YCount=anz_elemente_in_y)  # -> Geometry, Transform

# ----
debox_2 = DeconstructBox(Box=box_2)  # -> Plane, flatten(X), Y, Z
laenge_element = Panel([debox_2.X, debox.Y])

bbox_7 = BoundingBox(Content=item_3, Plane=PlaneXY(0, 0, 0))  # -> Box, Box_2
boxprop_7 = BoxProperties(Box=bbox_7.Box)  # -> Center, Diagonal, Area, Volume, Degeneracy
bbox_8 = BoundingBox(Content=[arrrec.Geometry, arrrec_2.Geometry], Plane=PlaneXY(0, 0, 0))  # -> Box, Box_2
boxprop_8 = BoxProperties(Box=bbox_8.Box)  # -> Center, Diagonal, Area, Volume, Degeneracy
vec2pt_3 = Vector2Pt(PointA=boxprop_7.Center, PointB=boxprop_8.Center, Unitize=False)  # -> Vector, Length
move_11 = Move(Geometry=loft_2, Motion=vec2pt_3.Vector)  # -> Geometry, Transform
move_12 = Move(Geometry=loft_3, Motion=vec2pt_3.Vector)  # -> Geometry, Transform
move_13 = Move(Geometry=loft, Motion=vec2pt_3.Vector)  # -> Geometry, Transform

geo = Geometry(<brep referenced from the Rhino model>)  # disabled
bbox_9 = BoundingBox(Content=geo, Plane=PlaneXY(0, 0, 0))  # -> Box, Box_2; disabled
boxprop_9 = BoxProperties(Box=bbox_9.Box)  # -> Center, Diagonal, Area, Volume, Degeneracy; disabled
vec2pt_4 = Vector2Pt(PointA=boxprop_9.Center, PointB=boxprop_8.Center, Unitize=False)  # -> Vector, Length; disabled
move_14 = Move(Geometry=geo, Motion=vec2pt_4.Vector)  # -> Geometry, Transform; disabled
