# Grasshopper definition studio2.gh (Grasshopper 1.0.7)
# plug-ins: MeshEdit Components, Pufferfish, Kangaroo Components, LunchBox, Weaverbird, MetaHopper, Kangaroo2 Components, Wombat, karambaGH, HFTidyCanvas

# ---- group: ALTERNATIVE MODELS / chamfer edges of pyramid
original_pyramid = Geometry(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)  # disabled
debrep = DeconstructBrep(Brep=original_pyramid)  # -> Faces, Edges, Vertices; disabled
lng = ListLength(List=debrep.Edges)  # disabled
subtraction = Subtraction(A=lng, B=1)  # disabled
dom = ConstructDomain(DomainStart=0, DomainEnd=subtraction)  # disabled
number_slider = Slider(0.12, range=0..3)  # disabled
range = Range(Domain=dom, Steps=subtraction)  # -> flatten(Range); disabled
filedge = FilletEdge(Shape=original_pyramid, Blend=1, Metric=0, Edges=range, Radii=number_slider)  # disabled
cap = CapHoles(Brep=filedge)  # disabled

# ---- group: ALTERNATIVE MODELS / extruded triangle
number_slider_2 = Slider(0.1, range=0..1)  # disabled
basic_triangle = Geometry(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)  # disabled
Z = UnitZ(Factor=number_slider_2)  # disabled
move = Move(Geometry=basic_triangle, Motion=Z)  # -> Geometry, Transform; disabled
debrep_2 = DeconstructBrep(Brep=[basic_triangle, move.Geometry])  # -> Faces, Edges, Vertices; disabled
join = JoinCurves(Curves=debrep_2.Edges, Preserve=False)  # -> flatten(Curves); disabled
number_slider_3 = Slider(6, range=0..8)  # disabled
loft = Loft(Curves=join, Options={Adjust=False, Closed=False, LoftEnds=0, LoftSimp=0, LoftType=0, Rebuild=10, Refit=0.01})  # disabled
join_2 = BrepJoin(Breps=[move.Geometry, loft, basic_triangle])  # -> Breps, Closed; disabled
debrep_3 = DeconstructBrep(Brep=join_2.Breps)  # -> Faces, Edges, Vertices; disabled
item = ListItem(List=debrep_3.Edges, Index=number_slider_3, Wrap=True)  # disabled

number_slider_4 = Slider(0.1, range=0..1)  # disabled
basic_triangle_2 = Geometry(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)  # disabled
Z_2 = UnitZ(Factor=number_slider_4)  # disabled
move_2 = Move(Geometry=basic_triangle_2, Motion=Z_2)  # -> Geometry, Transform; disabled
debrep_4 = DeconstructBrep(Brep=[basic_triangle_2, move_2.Geometry])  # -> Faces, Edges, Vertices; disabled
join_3 = JoinCurves(Curves=debrep_4.Edges, Preserve=False)  # -> flatten(Curves); disabled
number_slider_5 = Slider(6, range=0..8)  # disabled
loft_2 = Loft(Curves=join_3, Options={Adjust=False, Closed=False, LoftEnds=0, LoftSimp=0, LoftType=0, Rebuild=10, Refit=0.01})  # disabled
join_4 = BrepJoin(Breps=[move_2.Geometry, loft_2, basic_triangle_2])  # -> Breps, Closed; disabled
debrep_5 = DeconstructBrep(Brep=join_4.Breps)  # -> Faces, Edges, Vertices; disabled
item_2 = ListItem(List=debrep_5.Edges, Index=number_slider_5, Wrap=True)  # disabled

# ---- group: extruded triangle
number_slider_6 = Slider(0.1, range=0..1)
basic_triangle_3 = Geometry(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)
Z_3 = UnitZ(Factor=number_slider_6)
move_3 = Move(Geometry=basic_triangle_3, Motion=Z_3)  # -> Geometry, Transform
debrep_6 = DeconstructBrep(Brep=[basic_triangle_3, move_3.Geometry])  # -> Faces, Edges, Vertices
join_5 = JoinCurves(Curves=debrep_6.Edges, Preserve=False)  # -> flatten(Curves)
loft_3 = Loft(Curves=join_5, Options={Adjust=False, Closed=False, LoftEnds=0, LoftSimp=0, LoftType=0, Rebuild=10, Refit=0.01})
join_6 = BrepJoin(Breps=[move_3.Geometry, loft_3, basic_triangle_3])  # -> Breps, Closed
debrep_7 = DeconstructBrep(Brep=join_6.Breps)  # -> Faces, Edges, Vertices
item_3 = ListItem(List=debrep_7.Edges, Index=Slider(6, range=0..8), Wrap=True)

# ---- group: chamfer edges of pyramid
# model substitution of universal tri and pyras
original_pyramid_2 = Geometry(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)
debrep_8 = DeconstructBrep(Brep=original_pyramid_2)  # -> Faces, Edges, Vertices
lng_2 = ListLength(List=debrep_8.Edges)
subtraction_2 = Subtraction(A=lng_2, B=1)
dom_2 = ConstructDomain(DomainStart=0, DomainEnd=subtraction_2)
range_2 = Range(Domain=dom_2, Steps=subtraction_2)  # -> flatten(Range)
filedge_2 = FilletEdge(Shape=original_pyramid_2, Blend=1, Metric=0, Edges=range_2, Radii=Slider(0.12, range=0..3))
cap_2 = CapHoles(Brep=filedge_2)

# ----
swatch = ColourSwatch(SwatchColor=RGB(255, 255, 255))
toggle = BooleanToggle(True)
list = ValueList({"Normal": 1, "Faint": 2, "Hidden": 3}, selected="Faint")
canvas_color = CanvasColor(Toggle=toggle, BackgroundColor=swatch, GridColor=swatch)
get_groups = GetGroups()  # -> Groups, GroupStyles, Nickname, Color
vb = VBScript(wire=list, selected=toggle)  # -> out, A
# ---------- vb: VB ----------
    Dim document As GH_Document = owner.OnPingDocument()
    If (document Is Nothing) Then Return

    For Each att As IGH_Attributes In document.Attributes
      Dim param As IGH_Param = TryCast(att.DocObject, IGH_Param)
      If (param Is Nothing) Then Continue For

      If (selected And Not param.Attributes.GetTopLevel.Selected ) Then Continue For
      
      Select Case wire
        Case 2
          param.WireDisplay = GH_ParamWireDisplay.faint
        Case 3
          param.WireDisplay = GH_ParamWireDisplay.hidden
        Case Else
          param.WireDisplay = GH_ParamWireDisplay.Default
      End Select
    Next
# ---------- end vb ----------
set_group_properties = SetGroupProperties(Group=get_groups.Groups, Color=ColourSwatch(SwatchColor=RGB(204, 204, 204)))
sametype = GetObjectsOfSameType(Objects="test")
setpanel = SetPanelProperties(Panel=sametype, Color=ColourSwatch(SwatchColor=RGB(255, 255, 255)), FontSize=Slider(12, range=0..100))

# ---- group: ALTERNATIVE MODELS / MAIN
basic_triangle_4 = Geometry(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)  # disabled
number_slider_7 = Slider(0.138, range=0..1)  # disabled
subtraction_3 = Subtraction(A=1, B=number_slider_7)  # disabled
explode = Explode(Curve=basic_triangle_4, Recursive=True)  # -> Segments, Vertices; disabled
item_4 = ListItem(List=explode.Segments, Index=0, Wrap=True)  # disabled
len = Length(Curve=item_4)  # disabled
dom_3 = ConstructDomain(DomainStart=0, DomainEnd=len)  # disabled
remap = RemapNumbers(Value=subtraction_3, Source=Domain(0, 1), Target=dom_3)  # -> Mapped, Clipped; disabled
remap_2 = RemapNumbers(Value=number_slider_7, Source=Domain(0, 1), Target=dom_3)  # -> Mapped, Clipped; disabled
shatter = Shatter(Curve=explode.Segments, Parameters=[remap_2.Mapped, remap.Mapped])  # disabled
item_5 = ListItem(List=shatter, Index=1, Wrap=True)  # -> flatten(Item); disabled
explode_2 = Explode(Curve=item_5, Recursive=True)  # -> flatten(Segments), flatten(Vertices); disabled
cps = ClosestPoints(Point=explode_2.Vertices, Cloud=explode_2.Vertices, Count=2)  # -> ClosestPoint, CPIndex, Distance; disabled
item_6 = ListItem(List=cps.ClosestPoint, Index=1, Wrap=True)  # -> flatten(Item); disabled
ln = Line(StartPoint=explode_2.Vertices, EndPoint=item_6)  # -> flatten(Line); disabled
join_7 = JoinCurves(Curves=[item_5, ln], Preserve=False)  # disabled

# ---- group: ALTERNATIVE MODELS / mesh edge top
number_slider_8 = Slider(0.909, range=0.9..1)  # disabled
area = Area(Geometry=basic_triangle_4)  # -> Area, Centroid; disabled
scale = Scale(Geometry=basic_triangle_4, Center=area.Centroid, Factor=number_slider_8)  # -> Geometry, Transform; disabled
number_slider_9 = Slider(0.121, range=0..1)  # disabled
subtraction_4 = Subtraction(A=1, B=number_slider_9)  # disabled
explode_3 = Explode(Curve=scale.Geometry, Recursive=True)  # -> Segments, Vertices; disabled
item_7 = ListItem(List=explode_3.Segments, Index=0, Wrap=True)  # disabled
len_2 = Length(Curve=item_7)  # disabled
dom_4 = ConstructDomain(DomainStart=0, DomainEnd=len_2)  # disabled
remap_3 = RemapNumbers(Value=subtraction_4, Source=Domain(0, 1), Target=dom_4)  # -> Mapped, Clipped; disabled
remap_4 = RemapNumbers(Value=number_slider_9, Source=Domain(0, 1), Target=dom_4)  # -> Mapped, Clipped; disabled
shatter_2 = Shatter(Curve=explode_3.Segments, Parameters=[remap_4.Mapped, remap_3.Mapped])  # disabled
item_8 = ListItem(List=shatter_2, Index=1, Wrap=True)  # -> flatten(Item); disabled
explode_4 = Explode(Curve=item_8, Recursive=True)  # -> flatten(Segments), flatten(Vertices); disabled
cps_2 = ClosestPoints(Point=explode_4.Vertices, Cloud=explode_4.Vertices, Count=2)  # -> ClosestPoint, CPIndex, Distance; disabled
item_9 = ListItem(List=cps_2.ClosestPoint, Index=1, Wrap=True)  # -> flatten(Item); disabled
ln_2 = Line(StartPoint=explode_4.Vertices, EndPoint=item_9)  # -> flatten(Line); disabled
join_8 = JoinCurves(Curves=[item_8, ln_2], Preserve=False)  # disabled

# ---- group: ALTERNATIVE MODELS / CHAMFER
number_slider_10 = Slider(0.096, range=0..0.4)  # disabled
number_slider_11 = Slider(8, range=0..23)  # disabled
debrep_9 = DeconstructBrep(Brep=join_2.Breps)  # -> Faces, Edges, Vertices; disabled
merge = Merge(Data1=number_slider_10, Data2=number_slider_10, Data3=number_slider_10)  # disabled
item_10 = ListItem(List=debrep_9.Edges, Index=number_slider_11, Wrap=True)  # disabled
panel = Panel("""2
7
8""")  # disabled
filedge_3 = FilletEdge(Shape=join_2.Breps, Blend=1, Metric=0, Edges=panel, Radii=merge)  # disabled
cap_3 = CapHoles(Brep=filedge_3)  # disabled

# ---- group: ALTERNATIVE MODELS / scale pyra down and filter triangles
debrep_10 = DeconstructBrep(Brep=cap)  # -> Faces, Edges, Vertices; disabled
area_2 = Area(Geometry=debrep_10.Faces)  # -> Area, Centroid; disabled
list_goodies = CSharpScript(x=area_2.Area)  # -> out, sum, flatten(max), min, avg; inputs x: list of Double; disabled
# ---------- list_goodies: C# usings ----------
using System.IO;
using System.Linq;
using System.Data;
using System.Drawing;
using System.Reflection;
using System.Windows.Forms;
using System.Xml;
using System.Xml.Linq;
using System.Runtime.InteropServices;

using Rhino.DocObjects;
using Rhino.Collections;
using GH_IO;
using GH_IO.Serialization;
# ---------- list_goodies: C# ----------
    double sumx = 0;
    double maxx = 0;
    double minx = 1;
    double counter = 0;

    foreach (double t in x)
    {
      sumx += t;
      counter += 1;
      if (t > maxx)
        maxx = t;
      else if (t < minx )
        minx = t;
    }

    sum = sumx;
    max = maxx;
    min = minx;
    avg = maxx / counter;
# ---------- end list_goodies ----------
multiplication = Multiplication(A=list_goodies.max, B=0.99)  # disabled
larger = LargerThan(FirstNumber=area_2.Area, SecondNumber=multiplication)  # -> LargerThan, OrEqualTo; disabled
sift = SiftPattern(List=area_2.Centroid, SiftPattern=larger.LargerThan)  # -> Output0, Output1; disabled
sift_2 = SiftPattern(List=debrep_10.Faces, SiftPattern=larger.LargerThan)  # -> Output0, Output1; disabled

# ---- group: internalized mesh
geo = Geometry(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)  # disabled

# ---- group: ALTERNATIVE MODELS / scale pyra down and filter triangles
number_slider_12 = Slider(0.95, range=0..1)  # disabled
scale_2 = Scale(Geometry=cap, Center=Point(0, 0, 0), Factor=number_slider_12)  # -> Geometry, Transform; disabled
debrep_11 = DeconstructBrep(Brep=scale_2.Geometry)  # -> Faces, Edges, Vertices; disabled
area_3 = Area(Geometry=debrep_11.Faces)  # -> Area, Centroid; disabled
list_goodies_2 = CSharpScript(x=area_3.Area)  # -> out, sum, flatten(max), min, avg; inputs x: list of Double; disabled; same code as list_goodies
multiplication_2 = Multiplication(A=list_goodies_2.max, B=0.99)  # disabled
larger_2 = LargerThan(FirstNumber=area_3.Area, SecondNumber=multiplication_2)  # -> LargerThan, OrEqualTo; disabled
sift_3 = SiftPattern(List=debrep_11.Faces, SiftPattern=larger_2.LargerThan)  # -> Output0, Output1; disabled
sift_4 = SiftPattern(List=area_3.Centroid, SiftPattern=larger_2.LargerThan)  # -> Output0, Output1; disabled

# ---- group: separate triangles from solids
disjoint = DisjointMesh(Mesh=geo)  # -> flatten(Meshes); disabled
demesh = DeconstructMesh(Mesh=disjoint)  # -> Vertices, Faces, Colours, Normals; disabled
lng_3 = ListLength(List=demesh.Faces)  # disabled
larger_3 = LargerThan(FirstNumber=lng_3, SecondNumber=1)  # -> flatten(LargerThan), OrEqualTo; disabled
sift_5 = SiftPattern(List=disjoint, SiftPattern=larger_3.LargerThan)  # -> Output0, Output1; disabled
clean = CleanTree(RemoveNulls=True, RemoveInvalid=True, RemoveEmpty=False, Tree=sift_5.Output1)  # -> flatten(Tree); disabled
geo_2 = Geometry(clean)  # disabled

# ---- group: ALTERNATIVE MODELS / scale triangles for m3sh calc
debrep_12 = DeconstructBrep(Brep=join_2.Breps)  # -> Faces, Edges, Vertices; disabled
number_slider_13 = Slider(0.858, range=0.8..1)  # disabled
number_slider_14 = Slider(0.921, range=0.8..1)  # disabled
item_11 = ListItem(List=debrep_12.Faces, Index=4, Wrap=True)  # disabled
item_12 = ListItem(List=debrep_12.Faces, Index=0, Wrap=True)  # disabled
area_4 = Area(Geometry=item_12)  # -> Area, Centroid; disabled
area_5 = Area(Geometry=item_11)  # -> Area, Centroid; disabled
scale_3 = Scale(Geometry=item_11, Center=area_5.Centroid, Factor=number_slider_14)  # -> Geometry, Transform; disabled
scale_4 = Scale(Geometry=item_12, Center=area_4.Centroid, Factor=number_slider_14)  # -> Geometry, Transform; disabled

# ----
number_slider_15 = Slider(0.076, range=0..1)
area_6 = Area(Geometry=basic_triangle_3)  # -> Area, Centroid
scale_5 = Scale(Geometry=basic_triangle_3, Center=area_6.Centroid, Factor=Slider(0.883, range=0.7..1))  # -> Geometry, Transform
subtraction_5 = Subtraction(A=1, B=number_slider_15)
explode_5 = Explode(Curve=scale_5.Geometry, Recursive=True)  # -> Segments, Vertices
item_13 = ListItem(List=explode_5.Segments, Index=0, Wrap=True)
len_3 = Length(Curve=item_13)
dom_5 = ConstructDomain(DomainStart=0, DomainEnd=len_3)
remap_5 = RemapNumbers(Value=subtraction_5, Source=Domain(0, 1), Target=dom_5)  # -> Mapped, Clipped
remap_6 = RemapNumbers(Value=number_slider_15, Source=Domain(0, 1), Target=dom_5)  # -> Mapped, Clipped
shatter_3 = Shatter(Curve=explode_5.Segments, Parameters=[remap_6.Mapped, remap_5.Mapped])
item_14 = ListItem(List=shatter_3, Index=1, Wrap=True)  # -> flatten(Item)
explode_6 = Explode(Curve=item_14, Recursive=True)  # -> flatten(Segments), flatten(Vertices)
cps_3 = ClosestPoints(Point=explode_6.Vertices, Cloud=explode_6.Vertices, Count=2)  # -> ClosestPoint, CPIndex, Distance
item_15 = ListItem(List=cps_3.ClosestPoint, Index=1, Wrap=True)  # -> flatten(Item)
ln_3 = Line(StartPoint=explode_6.Vertices, EndPoint=item_15)  # -> flatten(Line)
join_9 = JoinCurves(Curves=[item_14, ln_3], Preserve=False)

# ---- group: scale pyra down and filter triangles
scale_6 = Scale(Geometry=cap_2, Center=Point(0, 0, 0), Factor=Slider(0.95, range=0..1))  # -> Geometry, Transform
debrep_13 = DeconstructBrep(Brep=scale_6.Geometry)  # -> Faces, Edges, Vertices
area_7 = Area(Geometry=debrep_13.Faces)  # -> Area, Centroid
list_goodies_3 = CSharpScript(x=area_7.Area)  # -> out, sum, flatten(max), min, avg; inputs x: list of Double; same code as list_goodies
multiplication_3 = Multiplication(A=list_goodies_3.max, B=0.99)
larger_4 = LargerThan(FirstNumber=area_7.Area, SecondNumber=multiplication_3)  # -> LargerThan, OrEqualTo
sift_6 = SiftPattern(List=debrep_13.Faces, SiftPattern=larger_4.LargerThan)  # -> Output0, Output1
sift_7 = SiftPattern(List=area_7.Centroid, SiftPattern=larger_4.LargerThan)  # -> Output0, Output1

debrep_14 = DeconstructBrep(Brep=cap_2)  # -> Faces, Edges, Vertices
area_8 = Area(Geometry=debrep_14.Faces)  # -> Area, Centroid
list_goodies_4 = CSharpScript(x=area_8.Area)  # -> out, sum, flatten(max), min, avg; inputs x: list of Double; same code as list_goodies
multiplication_4 = Multiplication(A=list_goodies_4.max, B=0.99)
larger_5 = LargerThan(FirstNumber=area_8.Area, SecondNumber=multiplication_4)  # -> LargerThan, OrEqualTo
sift_8 = SiftPattern(List=debrep_14.Faces, SiftPattern=larger_5.LargerThan)  # -> Output0, Output1
sift_9 = SiftPattern(List=area_8.Centroid, SiftPattern=larger_5.LargerThan)  # -> Output0, Output1

# ---- group: ALTERNATIVE MODELS
area_9 = Area(Geometry=basic_triangle_2)  # -> Area, Centroid; disabled
number_slider_16 = Slider(0.834, range=0.7..1)  # disabled
scale_7 = Scale(Geometry=basic_triangle_2, Center=area_9.Centroid, Factor=number_slider_16)  # -> Geometry, Transform; disabled
explode_7 = Explode(Curve=scale_7.Geometry, Recursive=True)  # -> Segments, Vertices; disabled
item_16 = ListItem(List=explode_7.Segments, Index=0, Wrap=True)  # disabled
len_4 = Length(Curve=item_16)  # disabled
number_slider_17 = Slider(0.099, range=0..1)  # disabled
dom_6 = ConstructDomain(DomainStart=0, DomainEnd=len_4)  # disabled
subtraction_6 = Subtraction(A=1, B=number_slider_17)  # disabled
remap_7 = RemapNumbers(Value=subtraction_6, Source=Domain(0, 1), Target=dom_6)  # -> Mapped, Clipped; disabled
remap_8 = RemapNumbers(Value=number_slider_17, Source=Domain(0, 1), Target=dom_6)  # -> Mapped, Clipped; disabled
shatter_4 = Shatter(Curve=explode_7.Segments, Parameters=[remap_8.Mapped, remap_7.Mapped])  # disabled
item_17 = ListItem(List=shatter_4, Index=1, Wrap=True)  # -> flatten(Item); disabled
explode_8 = Explode(Curve=item_17, Recursive=True)  # -> flatten(Segments), flatten(Vertices); disabled
cps_4 = ClosestPoints(Point=explode_8.Vertices, Cloud=explode_8.Vertices, Count=2)  # -> ClosestPoint, CPIndex, Distance; disabled
item_18 = ListItem(List=cps_4.ClosestPoint, Index=1, Wrap=True)  # -> flatten(Item); disabled
ln_4 = Line(StartPoint=explode_8.Vertices, EndPoint=item_18)  # -> flatten(Line); disabled
join_10 = JoinCurves(Curves=[item_17, ln_4], Preserve=False)  # disabled

area_10 = Area(Geometry=basic_triangle_2)  # -> Area, Centroid; disabled
number_slider_18 = Slider(0.834, range=0.7..1)  # disabled
scale_8 = Scale(Geometry=basic_triangle_2, Center=area_10.Centroid, Factor=number_slider_18)  # -> Geometry, Transform; disabled
explode_9 = Explode(Curve=scale_8.Geometry, Recursive=True)  # -> Segments, Vertices; disabled
item_19 = ListItem(List=explode_9.Segments, Index=0, Wrap=True)  # disabled
len_5 = Length(Curve=item_19)  # disabled
number_slider_19 = Slider(0.099, range=0..1)  # disabled
dom_7 = ConstructDomain(DomainStart=0, DomainEnd=len_5)  # disabled
subtraction_7 = Subtraction(A=1, B=number_slider_19)  # disabled
remap_9 = RemapNumbers(Value=subtraction_7, Source=Domain(0, 1), Target=dom_7)  # -> Mapped, Clipped; disabled
remap_10 = RemapNumbers(Value=number_slider_19, Source=Domain(0, 1), Target=dom_7)  # -> Mapped, Clipped; disabled
shatter_5 = Shatter(Curve=explode_9.Segments, Parameters=[remap_10.Mapped, remap_9.Mapped])  # disabled
item_20 = ListItem(List=shatter_5, Index=1, Wrap=True)  # -> flatten(Item); disabled
explode_10 = Explode(Curve=item_20, Recursive=True)  # -> flatten(Segments), flatten(Vertices); disabled
cps_5 = ClosestPoints(Point=explode_10.Vertices, Cloud=explode_10.Vertices, Count=2)  # -> ClosestPoint, CPIndex, Distance; disabled
item_21 = ListItem(List=cps_5.ClosestPoint, Index=1, Wrap=True)  # -> flatten(Item); disabled
ln_5 = Line(StartPoint=explode_10.Vertices, EndPoint=item_21)  # -> flatten(Line); disabled
join_11 = JoinCurves(Curves=[item_20, ln_5], Preserve=False)  # disabled

# ---- group: ALTERNATIVE MODELS / filter outside triangles
debrep_15 = DeconstructBrep(Brep=cap)  # -> Faces, Edges, Vertices; disabled
area_11 = Area(Geometry=debrep_15.Faces)  # -> Area, Centroid; disabled
list_goodies_5 = CSharpScript(x=area_11.Area)  # -> out, sum, flatten(max), min, avg; inputs x: list of Double; disabled; same code as list_goodies
multiplication_5 = Multiplication(A=list_goodies_5.max, B=0.99)  # disabled
larger_6 = LargerThan(FirstNumber=area_11.Area, SecondNumber=multiplication_5)  # -> LargerThan, OrEqualTo; disabled
sift_10 = SiftPattern(List=area_11.Centroid, SiftPattern=larger_6.LargerThan)  # -> Output0, Output1; disabled

# ---- group: ALTERNATIVE MODELS / scale pyra down and filter triangles / inside triangles
clean_2 = CleanTree(RemoveNulls=True, RemoveInvalid=True, RemoveEmpty=False, Tree=sift_2.Output1)  # disabled

# ---- group: ALTERNATIVE MODELS / scale pyra down and filter triangles / inside tria centers
clean_3 = CleanTree(RemoveNulls=True, RemoveInvalid=True, RemoveEmpty=False, Tree=sift.Output1)  # disabled

# ---- group: ALTERNATIVE MODELS / cutout for mesh trias
number_slider_20 = Slider(0.065, range=0..0.2)  # disabled
edges = BrepEdges(Brep=scale_3.Geometry)  # -> flatten(Naked), Interior, NonManifold; disabled
join_12 = JoinCurves(Curves=edges.Naked, Preserve=False)  # -> flatten(Curves); disabled
Z_4 = UnitZ(Factor=number_slider_20)  # disabled
move_4 = Move(Geometry=join_12, Motion=Z_4)  # -> Geometry, Transform; disabled
loft_4 = Loft(
    Curves=[join_12, move_4.Geometry],
    Options={Adjust=False, Closed=False, LoftEnds=0, LoftSimp=0, LoftType=0, Rebuild=10, Refit=0.01})  # disabled
number_slider_21 = Slider(14, range=0..14)  # disabled
cap_4 = CapHoles(Brep=loft_4)  # disabled
trim = TrimSolid(Shape=join_2.Breps, Cutters=cap_4)  # disabled
debrep_16 = DeconstructBrep(Brep=trim)  # -> Faces, Edges, Vertices; disabled
item_22 = ListItem(List=debrep_16.Edges, Index=number_slider_21, Wrap=True)  # disabled
len_6 = Length(Curve=item_22)  # disabled

# ---- group: scale pyra down and filter triangles / inside triangles
clean_4 = CleanTree(RemoveNulls=True, RemoveInvalid=True, RemoveEmpty=False, Tree=sift_6.Output1)

# ---- group: ALTERNATIVE MODELS / filter outside triangles / outside tria centers
clean_5 = CleanTree(RemoveNulls=True, RemoveInvalid=True, RemoveEmpty=False, Tree=sift_10.Output1)  # disabled

# ---- group: scale pyra down and filter triangles / outside triangles
clean_6 = CleanTree(RemoveNulls=True, RemoveInvalid=True, RemoveEmpty=False, Tree=sift_8.Output1)

# ---- group: scale pyra down and filter triangles / outside tria centers
clean_7 = CleanTree(RemoveNulls=True, RemoveInvalid=True, RemoveEmpty=False, Tree=sift_9.Output1)

# ---- group: ALTERNATIVE MODELS / scale pyra down and filter triangles / inside tria centers
clean_8 = CleanTree(RemoveNulls=True, RemoveInvalid=True, RemoveEmpty=False, Tree=sift_4.Output1)  # disabled

# ---- group: ALTERNATIVE MODELS / scale pyra down and filter triangles / inside triangles
clean_9 = CleanTree(RemoveNulls=True, RemoveInvalid=True, RemoveEmpty=False, Tree=sift_3.Output1)  # disabled

# ---- group: scale pyra down and filter triangles / inside tria centers
clean_10 = CleanTree(RemoveNulls=True, RemoveInvalid=True, RemoveEmpty=False, Tree=sift_7.Output1)

# ---- group: ALTERNATIVE MODELS / extrusion distance for tria extrusion
item_23 = ListItem(List=clean_8, Index=0, Wrap=True)  # disabled
item_24 = ListItem(List=clean_5, Index=0, Wrap=True)  # disabled
dist = Distance(PointA=item_24, PointB=item_23)  # disabled

# ---- group: convert mesh solids to brep solids because the volume command does not work when the mesh normals are not unified :/
demesh_2 = DeconstructMesh(Mesh=clean)  # -> Vertices, Faces, Colours, Normals; disabled
deface = DeconstructFace(Face=demesh_2.Faces)  # -> CornerA, CornerB, CornerC, CornerD; disabled
item_25 = ListItem(List=demesh_2.Vertices, Index=deface.CornerA, Wrap=True)  # disabled
item_26 = ListItem(List=demesh_2.Vertices, Index=deface.CornerB, Wrap=True)  # disabled
item_27 = ListItem(List=demesh_2.Vertices, Index=deface.CornerC, Wrap=True)  # disabled
srf4pt = _4PointSurface(CornerA=item_25, CornerB=item_26, CornerC=item_27)  # disabled
join_13 = BrepJoin(Breps=srf4pt)  # -> flatten(Breps), Closed; disabled
volume = Volume(Geometry=join_13.Breps)  # -> Volume, Centroid; disabled

# ---- group: extrusion distance for tria extrusion
item_28 = ListItem(List=clean_10, Index=0, Wrap=True)
item_29 = ListItem(List=clean_7, Index=0, Wrap=True)
dist_2 = Distance(PointA=item_29, PointB=item_28)

# ---- group: orient vector 4 original pyramid
original_pyramid_3 = Geometry(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)  # disabled
number_slider_22 = Slider(0, range=0..5)  # disabled
debrep_17 = DeconstructBrep(Brep=original_pyramid_3)  # -> Faces, Edges, Vertices; disabled
volume_2 = Volume(Geometry=original_pyramid_3)  # -> Volume, Centroid; disabled
item_30 = ListItem(List=debrep_17.Vertices, Index=number_slider_22, Wrap=True)  # disabled
vec2pt = Vector2Pt(PointA=volume_2.Centroid, PointB=item_30, Unitize=False)  # -> Vector, Length; disabled
pl = PlaneNormal(Origin=volume_2.Centroid, ZAxis=vec2pt.Vector)  # disabled

# ---- group: find most distant point in each solid to the centerpoint for axis alignment
demesh_3 = DeconstructMesh(Mesh=clean)  # -> simplify(Vertices), simplify(Faces), Colours, Normals; disabled
dist_3 = Distance(PointA=graft(volume.Centroid), PointB=demesh_3.Vertices)  # -> simplify(Distance); disabled
sort = SortList(Keys=dist_3, ValuesA=demesh_3.Vertices)  # -> Keys, ValuesA; disabled
item_31 = ListItem(List=sort.ValuesA, Index=5, Wrap=True)  # -> flatten(Item); disabled

# ---- group: orient vector of distorted pyramids
vec2pt_2 = Vector2Pt(PointA=flatten(volume.Centroid), PointB=item_31, Unitize=False)  # -> Vector, Length; disabled
pl_2 = PlaneNormal(Origin=volume.Centroid, ZAxis=vec2pt_2.Vector)  # disabled

# ---- group: orient original pyramid to centerpoint of all distorted ones
orient = Orient(Geometry=original_pyramid_3, Source=pl, Target=pl_2)  # -> flatten(Geometry), Transform; disabled
geo_3 = Geometry(orient.Geometry)  # disabled

# ---- group: triangles 4 substitution
number_slider_23 = Slider(0.32, range=0.01..0.5)  # disabled
wbvertices = WeaverbirdsVerticesComponent(MeshClosedPolylinesGroup=geo, Weld=True)  # -> flatten(Points); disabled
wbnaked = WeaverbirdsNakedBoundary(MeshClosedPolylines=geo)  # -> flatten(NakedCurves); disabled
sph = Sphere(Base=wbvertices, Radius=number_slider_23)  # disabled
sort_crv = SortDuplicateCurves(Curves=wbnaked)  # -> flatten(UniqueCurves), Indices; disabled
explode_11 = Explode(Curve=sort_crv.UniqueCurves, Recursive=True)  # -> Segments, Vertices; disabled
area_12 = Area(Geometry=sort_crv.UniqueCurves)  # -> Area, flatten(Centroid); disabled
item_32 = ListItem(List=explode_11.Vertices, Index=0, Wrap=True)  # -> flatten(Item); disabled
item_33 = ListItem(List=explode_11.Vertices, Index=1, Wrap=True)  # -> flatten(Item); disabled
number_slider_24 = Slider(1.1, range=0.1..3)  # disabled
pl_3pt = Plane3Pt(PointA=area_12.Centroid, PointB=item_32, PointC=item_33)  # disabled
polygon = Polygon(Plane=pl_3pt, Radius=number_slider_24, Segments=3, FilletRadius=0)  # -> Polygon, Length; disabled

# ---- group: initial centers
area_13 = Area(Geometry=polygon.Polygon)  # -> Area, Centroid; disabled

# ---- group: CHAMFER
number_slider_25 = Slider(0.096, range=0..0.4)  # disabled
number_slider_26 = Slider(8, range=0..23)  # disabled
debrep_18 = DeconstructBrep(Brep=join_6.Breps)  # -> Faces, Edges, Vertices; disabled
merge_2 = Merge(Data1=number_slider_25, Data2=number_slider_25, Data3=number_slider_25)  # disabled
item_34 = ListItem(List=debrep_18.Edges, Index=number_slider_26, Wrap=True)  # disabled
panel_2 = Panel("""2
7
8""")  # disabled
filedge_4 = FilletEdge(Shape=join_6.Breps, Blend=1, Metric=0, Edges=panel_2, Radii=merge_2)  # disabled
cap_5 = CapHoles(Brep=filedge_4)  # disabled

# ---- group: ALTERNATIVE MODELS / CHAMFER
number_slider_27 = Slider(0.096, range=0..0.4)  # disabled
number_slider_28 = Slider(8, range=0..23)  # disabled
debrep_19 = DeconstructBrep(Brep=join_4.Breps)  # -> Faces, Edges, Vertices; disabled
merge_3 = Merge(Data1=number_slider_27, Data2=number_slider_27, Data3=number_slider_27)  # disabled
item_35 = ListItem(List=debrep_19.Edges, Index=number_slider_28, Wrap=True)  # disabled
panel_3 = Panel("""2
7
8""")  # disabled
filedge_5 = FilletEdge(Shape=join_4.Breps, Blend=1, Metric=0, Edges=panel_3, Radii=merge_3)  # disabled
cap_6 = CapHoles(Brep=filedge_5)  # disabled

# ---- group: ALTERNATIVE MODELS / SHADOW PROJECTION
path = FilePath("C:\Users\romaz\Desktop\STUDIO\CHN_Shanghai.Shanghai.583620_SWERA.epw")  # disabled
Y = UnitY(Factor=1)  # disabled
xy = XYPlane(Origin=Point(0, 0, 0))  # disabled
importepw = Ladybug_ImportEpw(epwFile=path)  # -> readMe, latitude, location, dryBulbTemperature, dewPointTemperature, relativeHumidity, windSpeed, windDirection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; disabled; plug-in component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
number_slider_29 = Slider(12, range=1..24)  # disabled
number_slider_30 = Slider(21, range=1..31)  # disabled
number_slider_31 = Slider(6, range=1..12)  # disabled
number_slider_32 = Slider(-1, range=-120..0)  # disabled
sunpath = Ladybug_SunPath(
    north=Y,
    location=importepw.location,
    hour=number_slider_29,
    day=number_slider_30,
    month=number_slider_31,
    dailyOrAnnualSunPath=True)  # -> readMe, sunVectors, sunAltitudes, sunAzimuths, port, sunSpheresMesh, sunPathCrvs, compassCrvs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; disabled; plug-in component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
pl_offset = PlaneOffset(BasePlane=xy, Offset=number_slider_32)  # disabled
mesh = Mesh()  # disabled
projecta = ProjectAlong(Geometry=mesh, Plane=pl_offset, Direction=sunpath.sunVectors)  # -> flatten(Geometry), Transform; disabled

# ---- group: ALTERNATIVE MODELS / CHAMFER
number_slider_33 = Slider(0, range=0..0.1)
number_slider_34 = Slider(0.068, range=0.001..0.3)
panel_4 = Panel("""0
1
3
4
5
6
2
7
8""")
merge_4 = Merge(
    Data1=number_slider_33,
    Data2=number_slider_33,
    Data3=number_slider_33,
    Data4=number_slider_33,
    Data5=number_slider_33,
    Data6=number_slider_33,
    Data7=number_slider_34,
    Data8=number_slider_34,
    Data9=number_slider_34)
filedge_6 = FilletEdge(Blend=1, Metric=0, Edges=panel_4, Radii=merge_4)
debrep_20 = DeconstructBrep(Brep=filedge_6)  # -> Faces, Edges, Vertices
item_36 = ListItem(List=debrep_20.Edges, Index=Slider(23, range=0..23), Wrap=True)

# ---- group: ALTERNATIVE MODELS / FILLET
number_slider_35 = Slider(0.025, range=0..0.1)
number_slider_36 = Slider(0.005, range=0.001..0.3)
panel_5 = Panel("""6
7
8
9
10
11
12
13
14
15
16
17
18
19
20
21
22
23""")
merge_5 = Merge(
    Data1=number_slider_35,
    Data2=number_slider_35,
    Data3=number_slider_35,
    Data4=number_slider_35,
    Data5=number_slider_35,
    Data6=number_slider_35,
    Data7=number_slider_36,
    Data8=number_slider_36,
    Data9=number_slider_36,
    Data10=number_slider_36,
    Data11=number_slider_36,
    Data12=number_slider_36,
    Data13=number_slider_36,
    Data14=number_slider_36,
    Data15=number_slider_36,
    Data16=number_slider_36,
    Data17=number_slider_36,
    Data18=number_slider_36)
filedge_7 = FilletEdge(Shape=filedge_6, Blend=0, Metric=0, Edges=panel_5, Radii=merge_5)

# ---- group: ALTERNATIVE MODELS
list_goodies_6 = CSharpScript()  # -> out, sum, flatten(max), min, avg; inputs x: list of Double; disabled; same code as list_goodies
ladybug = Ladybug_Ladybug()  # -> Vviiiiiiiiiizzz; disabled; plug-in component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

# ---- group: ALTERNATIVE MODELS / assembly
join_14 = BrepJoin(Breps=filedge_7)  # -> Breps, Closed
area_14 = Area(Geometry=join_14.Breps)  # -> Area, Centroid
geo_4 = Geometry(area_14.Centroid)

# ---- group: ALTERNATIVE MODELS / bottom inset
number_slider_37 = Slider(0.941, range=0.9..1)  # disabled
number_slider_38 = Slider(0.112, range=0..1)  # disabled
subtraction_8 = Subtraction(A=1, B=number_slider_38)  # disabled

# ---- group: ALTERNATIVE MODELS
explode_12 = Explode(Curve=basic_triangle_2, Recursive=True)  # -> Segments, Vertices; disabled
geo_5 = Geometry(debrep.Faces)  # disabled
number_slider_39 = Slider(0.226, range=0..0.5)  # disabled
number_slider_40 = Slider(0.076, range=0..0.5)  # disabled
Z_5 = UnitZ(Factor=number_slider_39)  # disabled
scale_9 = Scale(Geometry=original_pyramid, Center=Point(0, 0, 0), Factor=number_slider_12)  # -> Geometry, Transform; disabled
Z_6 = UnitZ(Factor=number_slider_40)  # disabled
move_5 = Move(Geometry=join_10, Motion=flatten(Z_5))  # -> Geometry, Transform; disabled
item_37 = ListItem(List=join_10, Index=0, Wrap=True)  # disabled
item_38 = ListItem(List=join_11, Index=0, Wrap=True)  # disabled
move_6 = Move(Geometry=join_11, Motion=flatten(Z_6))  # -> Geometry, Transform; disabled
edges_2 = BrepEdges(Brep=debrep.Faces)  # -> Naked, Interior, NonManifold; disabled
join_15 = JoinCurves(Curves=edges_2.Naked, Preserve=False)  # -> flatten(Curves); disabled
debrep_21 = DeconstructBrep(Brep=debrep.Faces)  # -> Faces, Edges, simplify(Vertices); disabled
debrep_22 = DeconstructBrep(Brep=scale_9.Geometry)  # -> Faces, Edges, simplify(Vertices); disabled
edges_3 = BrepEdges(Brep=debrep_22.Faces)  # -> Naked, Interior, NonManifold; disabled
join_16 = JoinCurves(Curves=edges_3.Naked, Preserve=False)  # -> flatten(Curves); disabled
item_39 = ListItem(List=debrep_21.Vertices, Index=0, Wrap=True)  # disabled
item_40 = ListItem(List=debrep_21.Vertices, Index=1, Wrap=True)  # disabled
item_41 = ListItem(List=debrep_21.Vertices, Index=2, Wrap=True)  # disabled
item_42 = ListItem(List=debrep_22.Vertices, Index=0, Wrap=True)  # disabled
item_43 = ListItem(List=debrep_22.Vertices, Index=1, Wrap=True)  # disabled
item_44 = ListItem(List=debrep_22.Vertices, Index=2, Wrap=True)  # disabled
number_slider_41 = Slider(0.057, range=0..1)  # disabled
subtraction_9 = Subtraction(A=1, B=number_slider_41)  # disabled
subtraction_10 = Subtraction(A=1, B=number_slider_41)  # disabled
pl_3pt_2 = Plane3Pt(PointA=item_39, PointB=item_40, PointC=item_41)  # disabled
area_15 = Area(Geometry=join_15)  # -> Area, Centroid; disabled
area_16 = Area(Geometry=join_16)  # -> Area, Centroid; disabled
pl_3pt_3 = Plane3Pt(PointA=item_42, PointB=item_43, PointC=item_44)  # disabled
number_slider_42 = Slider(0.8, range=0.5..1)  # disabled
number_slider_43 = Slider(0.8, range=0.5..1)  # disabled
scale_10 = Scale(Geometry=join_15, Center=area_15.Centroid, Factor=number_slider_42)  # -> Geometry, Transform; disabled
edges_4 = BrepEdges(Brep=scale_10.Geometry)  # -> flatten(Naked), Interior, NonManifold; disabled
explode_13 = Explode(Curve=edges_4.Naked, Recursive=True)  # -> Segments, Vertices; disabled
item_45 = ListItem(List=explode_13.Segments, Index=0, Wrap=True)  # disabled
len_7 = Length(Curve=item_45)  # disabled
dom_8 = ConstructDomain(DomainStart=0, DomainEnd=len_7)  # disabled
scale_11 = Scale(Geometry=join_16, Center=area_16.Centroid, Factor=number_slider_42)  # -> Geometry, Transform; disabled
edges_5 = BrepEdges(Brep=scale_11.Geometry)  # -> flatten(Naked), Interior, NonManifold; disabled
explode_14 = Explode(Curve=edges_5.Naked, Recursive=True)  # -> Segments, Vertices; disabled
item_46 = ListItem(List=explode_14.Segments, Index=0, Wrap=True)  # disabled
len_8 = Length(Curve=item_46)  # disabled
dom_9 = ConstructDomain(DomainStart=0, DomainEnd=len_8)  # disabled
remap_11 = RemapNumbers(Value=number_slider_41, Source=Domain(0, 1), Target=dom_8)  # -> Mapped, Clipped; disabled
remap_12 = RemapNumbers(Value=subtraction_9, Source=Domain(0, 1), Target=dom_8)  # -> Mapped, Clipped; disabled
remap_13 = RemapNumbers(Value=subtraction_10, Source=Domain(0, 1), Target=dom_9)  # -> Mapped, Clipped; disabled
remap_14 = RemapNumbers(Value=number_slider_41, Source=Domain(0, 1), Target=dom_9)  # -> Mapped, Clipped; disabled
shatter_6 = Shatter(Curve=explode_13.Segments, Parameters=[remap_11.Mapped, remap_12.Mapped])  # disabled
shatter_7 = Shatter(Curve=explode_14.Segments, Parameters=[remap_14.Mapped, remap_13.Mapped])  # disabled
item_47 = ListItem(List=shatter_6, Index=1, Wrap=True)  # -> flatten(Item); disabled
item_48 = ListItem(List=shatter_7, Index=1, Wrap=True)  # -> flatten(Item); disabled
panel_6 = Panel(item_39)  # disabled
explode_15 = Explode(Curve=item_47, Recursive=True)  # -> flatten(Segments), flatten(Vertices); disabled
explode_16 = Explode(Curve=item_48, Recursive=True)  # -> flatten(Segments), flatten(Vertices); disabled
cps_6 = ClosestPoints(Point=explode_15.Vertices, Cloud=explode_15.Vertices, Count=2)  # -> ClosestPoint, CPIndex, Distance; disabled
cps_7 = ClosestPoints(Point=explode_16.Vertices, Cloud=explode_16.Vertices, Count=2)  # -> ClosestPoint, CPIndex, Distance; disabled
item_49 = ListItem(List=cps_6.ClosestPoint, Index=1, Wrap=True)  # -> flatten(Item); disabled
item_50 = ListItem(List=cps_7.ClosestPoint, Index=1, Wrap=True)  # -> flatten(Item); disabled
move_7 = Move(Geometry=join_10, Motion=flatten(Z_2))  # -> Geometry, Transform; disabled
ln_6 = Line(StartPoint=explode_15.Vertices, EndPoint=item_49)  # -> flatten(Line); disabled
ln_7 = Line(StartPoint=explode_16.Vertices, EndPoint=item_50)  # -> flatten(Line); disabled
item_51 = ListItem(List=move_7.Geometry, Index=0, Wrap=True)  # disabled
item_52 = ListItem(List=move_5.Geometry, Index=0, Wrap=True)  # disabled
join_17 = JoinCurves(Curves=[item_47, ln_6], Preserve=False)  # disabled
join_18 = JoinCurves(Curves=[item_48, ln_7], Preserve=False)  # disabled
boundary = BoundarySurfaces(Edges=[item_51, item_52])  # disabled
item_53 = ListItem(List=join_17, Index=0, Wrap=True)  # disabled
item_54 = ListItem(List=join_18, Index=0, Wrap=True)  # disabled
number_slider_44 = Slider(3, range=0..10)  # disabled
boundary_2 = BoundarySurfaces(Edges=join_17)  # disabled
srf = Surface(boundary_2)  # disabled
boundary_3 = BoundarySurfaces(Edges=join_18)  # disabled
mesh_2 = Mesh(boundary)  # disabled
edges_6 = BrepEdges(Brep=[boundary_2, boundary_3])  # -> flatten(Naked), Interior, NonManifold; disabled
wbloop = WeaverbirdsLoopSubdivision(MeshCurves=mesh_2, Level=number_slider_44, SmoothNakedEdges=2)  # disabled
wbedges = WeaverbirdsMeshEdges(MeshOrPolylines=wbloop)  # disabled
boundary_4 = BoundarySurfaces(Edges=edges_6.Naked)  # disabled
mesh_3 = Mesh(flatten(wbloop))  # disabled
mesh_4 = Mesh(boundary_4)  # disabled
number_slider_45 = Slider(3, range=0..5)  # disabled
item_55 = ListItem(List=mesh_4, Index=[0, 1, 4, 7, 8, 9, 12, 15], Wrap=True)  # disabled
item_56 = ListItem(List=mesh_4, Index=[2, 3, 5, 6, 10, 11, 13, 14], Wrap=True)  # disabled
number_slider_46 = Slider(2052, range=0..5000)  # disabled
flip = MeshFlip(Mesh=item_55)  # disabled
merge_6 = Merge(Data1=item_56, Data2=flip)  # -> flatten(Result); disabled
wbloop_2 = WeaverbirdsLoopSubdivision(MeshCurves=merge_6, Level=number_slider_45, SmoothNakedEdges=2)  # -> flatten(OutputMeshCurves); disabled
mesh_5 = Mesh(wbloop_2)  # disabled
number_slider_47 = Slider(15, range=0..15)  # disabled
item_57 = ListItem(List=mesh_5, Index=number_slider_47, Wrap=True)  # disabled
number_slider_48 = Slider(-50, range=-50..50)  # disabled
number_slider_49 = Slider(-50, range=-50..50)  # disabled

debrep_23 = DeconstructBrep(Brep=clean_2)  # -> Faces, Edges, Vertices; disabled
item_58 = ListItem(List=debrep_23.Vertices, Index=0, Wrap=True)  # -> flatten(Item); disabled
item_59 = ListItem(List=debrep_23.Vertices, Index=1, Wrap=True)  # -> flatten(Item); disabled
area_17 = Area(Geometry=clean_2)  # -> Area, Centroid; disabled
pl_3pt_4 = Plane3Pt(PointA=area_17.Centroid, PointB=item_58, PointC=item_59)  # disabled
vec2pt_3 = Vector2Pt(PointA=area_17.Centroid, PointB=item_58, Unitize=False)  # -> Vector, Length; disabled
debrep_24 = DeconstructBrep(Brep=basic_triangle_2)  # -> Faces, Edges, Vertices; disabled
item_60 = ListItem(List=debrep_24.Vertices, Index=0, Wrap=True)  # -> flatten(Item); disabled
orient_2 = Orient(Geometry=item_60, Source=PlaneXY(0, 0, 0), Target=pl_3pt_4)  # -> Geometry, Transform; disabled
item_61 = ListItem(List=move_6.Geometry, Index=0, Wrap=True)  # disabled
orient_3 = Orient(Geometry=item_61, Source=PlaneXY(0, 0, 0), Target=pl_3pt_4)  # -> Geometry, Transform; disabled
area_18 = Area(Geometry=orient_3.Geometry)  # -> Area, Centroid; disabled
vec2pt_4 = Vector2Pt(PointA=area_18.Centroid, PointB=orient_2.Geometry, Unitize=False)  # -> Vector, Length; disabled
angle = Angle(VectorA=vec2pt_3.Vector, VectorB=vec2pt_4.Vector, Plane=pl_3pt_4)  # -> Angle, Reflex; disabled
neg = Negative(Value=angle.Angle)  # disabled
rotate = Rotate(Geometry=orient_3.Geometry, Angle=neg, Plane=pl_3pt_4)  # -> Geometry, Transform; disabled

debrep_25 = DeconstructBrep(Brep=clean_9)  # -> Faces, Edges, Vertices; disabled
item_62 = ListItem(List=debrep_25.Vertices, Index=0, Wrap=True)  # -> flatten(Item); disabled
item_63 = ListItem(List=debrep_25.Vertices, Index=1, Wrap=True)  # -> flatten(Item); disabled
area_19 = Area(Geometry=clean_9)  # -> Area, Centroid; disabled
pl_3pt_5 = Plane3Pt(PointA=area_19.Centroid, PointB=item_62, PointC=item_63)  # disabled
vec2pt_5 = Vector2Pt(PointA=area_19.Centroid, PointB=item_62, Unitize=False)  # -> Vector, Length; disabled
debrep_26 = DeconstructBrep(Brep=basic_triangle_2)  # -> Faces, Edges, Vertices; disabled
item_64 = ListItem(List=debrep_26.Vertices, Index=0, Wrap=True)  # -> flatten(Item); disabled
orient_4 = Orient(Geometry=item_64, Source=PlaneXY(0, 0, 0), Target=pl_3pt_5)  # -> Geometry, Transform; disabled
item_65 = ListItem(List=move_6.Geometry, Index=0, Wrap=True)  # disabled
orient_5 = Orient(Geometry=item_65, Source=PlaneXY(0, 0, 0), Target=pl_3pt_5)  # -> Geometry, Transform; disabled
area_20 = Area(Geometry=orient_5.Geometry)  # -> Area, Centroid; disabled
vec2pt_6 = Vector2Pt(PointA=area_20.Centroid, PointB=orient_4.Geometry, Unitize=False)  # -> Vector, Length; disabled
angle_2 = Angle(VectorA=vec2pt_5.Vector, VectorB=vec2pt_6.Vector, Plane=pl_3pt_5)  # -> Angle, Reflex; disabled
neg_2 = Negative(Value=angle_2.Angle)  # disabled
rotate_2 = Rotate(Geometry=orient_5.Geometry, Angle=neg_2, Plane=pl_3pt_5)  # -> Geometry, Transform; disabled

# ---- group: ALTERNATIVE MODELS / scale inside trias for meshpocket and extrude inner trias
number_slider_50 = Slider(0.87, range=0..1)  # disabled
area_21 = Area(Geometry=original_pyramid)  # -> Area, Centroid; disabled
vec2pt_7 = Vector2Pt(PointA=area_21.Centroid, PointB=clean_8, Unitize=False)  # -> Vector, Length; disabled
unit = UnitVector(Vector=vec2pt_7.Vector)  # disabled
scale_12 = Scale(Geometry=srf, Center=clean_8, Factor=number_slider_50)  # -> Geometry, Transform; disabled
multiplication_6 = Multiplication(A=unit, B=dist)  # disabled
extr = Extrude(Base=scale_12.Geometry, Direction=multiplication_6)  # disabled

# ---- group: ALTERNATIVE MODELS / bits n bolts and pressures / inside outside sorting
item_66 = ListItem(List=flatten(mesh_3), Index=0, Wrap=True)  # disabled
item_67 = ListItem(List=flatten(mesh_3), Index=1, Wrap=True)  # disabled

# ---- group: ALTERNATIVE MODELS / bits n bolts and pressures
number_slider_51 = Slider(46, range=0..1000)  # disabled
number_slider_52 = Slider(18, range=0..1000)  # disabled
wbedges_2 = WeaverbirdsMeshEdges(MeshOrPolylines=mesh_3)  # disabled
meshpressure = MeshPressure(M=item_66, pressurelevel=number_slider_52)  # disabled
meshpressure_2 = MeshPressure(M=item_67, pressurelevel=number_slider_51)  # disabled
len_9 = Length(Curve=wbedges_2)  # disabled
springs = SpringsFromLine(
    Connection=wbedges_2,
    Stiffness=number_slider_46,
    Damping=10,
    RestLength=len_9,
    UpperCutoff=0,
    LowerCutoff=0,
    Plasticity=0)  # disabled
merge_7 = Merge(Data1=springs, Data2=meshpressure_2, Data3=meshpressure)  # -> flatten(Result); disabled

# ---- group: ALTERNATIVE MODELS / anchors
wbnaked_2 = WeaverbirdsNakedBoundary(MeshClosedPolylines=mesh_5)  # disabled
join_19 = JoinCurves(Curves=wbnaked_2, Preserve=False)  # disabled
wbvertices_2 = WeaverbirdsVerticesComponent(MeshClosedPolylinesGroup=mesh_5, Weld=True)  # -> simplify(Points); disabled
crv_cp = CurveClosestPoint(Point=wbvertices_2, Curve=graft(wbnaked_2))  # -> Point, Parameter, Distance; disabled
equals = Equality(FirstNumber=crv_cp.Distance, SecondNumber=0)  # -> simplify(Equality), Inequality; disabled
sift_11 = SiftPattern(List=simplify(wbvertices_2), SiftPattern=equals.Equality)  # -> Output0, Output1; disabled
geo_6 = Geometry(sift_11.Output1)  # disabled

# ---- group: ALTERNATIVE MODELS / bits n bolts and pressures / inside outside sorting
item_68 = ListItem(List=flatten(mesh_5), Index=[0, 1, 2, 3, 8, 9, 10, 11], Wrap=True)  # disabled
item_69 = ListItem(List=flatten(mesh_5), Index=[4, 5, 6, 7, 12, 13, 14, 15], Wrap=True)  # disabled

# ---- group: ALTERNATIVE MODELS / bits n bolts and pressures
wbedges_3 = WeaverbirdsMeshEdges(MeshOrPolylines=mesh_5)  # disabled
meshpressure_3 = MeshPressure(M=item_68, pressurelevel=number_slider_49)  # disabled
meshpressure_4 = MeshPressure(M=item_69, pressurelevel=number_slider_48)  # disabled
len_10 = Length(Curve=wbedges_3)  # disabled
springs_2 = SpringsFromLine(Connection=wbedges_3, Stiffness=1000, Damping=10, RestLength=len_10, UpperCutoff=0, LowerCutoff=0, Plasticity=0)  # disabled
merge_8 = Merge(Data1=springs_2, Data2=meshpressure_3, Data3=meshpressure_4)  # -> flatten(Result); disabled

# ---- group: ALTERNATIVE MODELS / finest australian engine
button = Button()  # disabled
kangaroo = KangarooPhysics(ForceObjects=merge_8, AnchorPoints=flatten(geo_6), Settings=null, Geometry=mesh_5, SimulationReset=button)  # -> Out, Iterations, ParticlesOut, GeometryOut, KE; disabled
timer = Timer(TimerInterval=20, Target=kangaroo)  # disabled
geo_7 = Geometry(flatten(kangaroo.GeometryOut))  # disabled

# ----
explode_17 = Explode(Curve=basic_triangle_3, Recursive=True)  # -> Segments, Vertices
finished_pyra = Geometry([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])  # disabled
number_slider_53 = Slider(1, range=0.8..1.2)  # disabled
area_22 = Area(Geometry=finished_pyra)  # -> Area, Centroid; disabled
scale_13 = Scale(Geometry=finished_pyra, Center=area_22.Centroid, Factor=number_slider_53)  # -> Geometry, Transform; disabled
mesh_6 = Mesh(scale_13.Geometry)  # disabled
Z_7 = UnitZ(Factor=Slider(0.066, range=0..0.5))
item_70 = ListItem(List=join_9, Index=0, Wrap=True)
move_8 = Move(Geometry=join_9, Motion=flatten(Z_7))  # -> Geometry, Transform
move_9 = Move(Geometry=join_9, Motion=flatten(Z_3))  # -> Geometry, Transform
item_71 = ListItem(List=move_9.Geometry, Index=0, Wrap=True)
item_72 = ListItem(List=move_8.Geometry, Index=0, Wrap=True)
boundary_5 = BoundarySurfaces(Edges=[item_71, item_72])
mesh_7 = Mesh(boundary_5)
wbloop_3 = WeaverbirdsLoopSubdivision(MeshCurves=mesh_7, Level=Slider(3, range=0..10), SmoothNakedEdges=2)
wbedges_4 = WeaverbirdsMeshEdges(MeshOrPolylines=wbloop_3)
orient_6 = Orient(Geometry=mesh_6, Source=pl, Target=pl_2)  # -> flatten(Geometry), Transform; disabled
mesh_8 = Mesh(flatten(wbloop_3))  # disabled
number_slider_54 = Slider(2052, range=0..5000)  # disabled
number_slider_55 = Slider(1, range=0.8..1.5)  # disabled
number_slider_56 = Slider(0, range=-0.5..0.5)  # disabled

# ---- group: bits n bolts and pressures / inside outside sorting
item_73 = ListItem(List=flatten(mesh_8), Index=0, Wrap=True)  # disabled
item_74 = ListItem(List=flatten(mesh_8), Index=1, Wrap=True)  # disabled

# ---- group: bits n bolts and pressures
number_slider_57 = Slider(46, range=0..1000)  # disabled
number_slider_58 = Slider(18, range=0..1000)  # disabled
wbedges_5 = WeaverbirdsMeshEdges(MeshOrPolylines=mesh_8)  # disabled
meshpressure_5 = MeshPressure(M=item_73, pressurelevel=number_slider_58)  # disabled
meshpressure_6 = MeshPressure(M=item_74, pressurelevel=number_slider_57)  # disabled
len_11 = Length(Curve=wbedges_5)  # disabled
springs_3 = SpringsFromLine(
    Connection=wbedges_5,
    Stiffness=number_slider_54,
    Damping=10,
    RestLength=len_11,
    UpperCutoff=0,
    LowerCutoff=0,
    Plasticity=0)  # disabled
merge_9 = Merge(Data1=springs_3, Data2=meshpressure_6, Data3=meshpressure_5)  # -> flatten(Result); disabled

# ---- group: fix rotation issue
cir = Circle(Plane=pl_2, Radius=1)  # -> simplify(graft(Circle)); disabled
debrep_27 = DeconstructBrep(Brep=orient.Geometry)  # -> Faces, Edges, simplify(Vertices); disabled
crv_cp_2 = CurveClosestPoint(Point=demesh_3.Vertices, Curve=cir)  # -> Point, Parameter, Distance; disabled
crv_cp_3 = CurveClosestPoint(Point=debrep_27.Vertices, Curve=cir)  # -> Point, Parameter, Distance; disabled
sort_2 = SortList(Keys=crv_cp_2.Distance, ValuesA=demesh_3.Vertices)  # -> Keys, ValuesA; disabled
sort_3 = SortList(Keys=crv_cp_3.Distance, ValuesA=debrep_27.Vertices)  # -> Keys, ValuesA; disabled
item_75 = ListItem(List=sort_3.ValuesA, Index=0, Wrap=True)  # -> flatten(Item); disabled
item_76 = ListItem(List=sort_2.ValuesA, Index=0, Wrap=True)  # -> flatten(Item); disabled
vec2pt_8 = Vector2Pt(PointA=volume.Centroid, PointB=item_76, Unitize=False)  # -> Vector, Length; disabled
vec2pt_9 = Vector2Pt(PointA=volume.Centroid, PointB=item_75, Unitize=False)  # -> Vector, Length; disabled
angle_3 = Angle(VectorA=vec2pt_8.Vector, VectorB=vec2pt_9.Vector, Plane=pl_2)  # -> Angle, Reflex; disabled
neg_3 = Negative(Value=angle_3.Angle)  # disabled
rot3d = Rotate3D(Geometry=orient_6.Geometry, Angle=neg_3, Center=volume.Centroid, Axis=vec2pt_2.Vector)  # -> Geometry, Transform; disabled

# ---- group: initial orientation point orient
three_points = Geometry(explode_17.Vertices)  # disabled
item_77 = ListItem(List=three_points, Index=2, Wrap=True)  # disabled
orient_7 = Orient(Geometry=item_77, Source=PlaneXY(0, 0, 0), Target=pl_3pt)  # -> Geometry, Transform; disabled

# ---- group: ALTERNATIVE MODELS
number_slider_59 = Slider(0.1, range=0..1)  # disabled
Z_8 = UnitZ(Factor=number_slider_59)  # disabled
move_10 = Move(Geometry=basic_triangle_4, Motion=Z_8)  # -> Geometry, Transform; disabled
debrep_28 = DeconstructBrep(Brep=[basic_triangle_4, move_10.Geometry])  # -> Faces, Edges, Vertices; disabled
join_20 = JoinCurves(Curves=debrep_28.Edges, Preserve=False)  # -> flatten(Curves); disabled
number_slider_60 = Slider(6, range=0..8)  # disabled
loft_5 = Loft(Curves=join_20, Options={Adjust=False, Closed=False, LoftEnds=0, LoftSimp=0, LoftType=0, Rebuild=10, Refit=0.01})  # disabled
join_21 = BrepJoin(Breps=[move_10.Geometry, loft_5, basic_triangle_4])  # -> Breps, Closed; disabled
debrep_29 = DeconstructBrep(Brep=join_21.Breps)  # -> Faces, Edges, Vertices; disabled
item_78 = ListItem(List=debrep_29.Edges, Index=number_slider_60, Wrap=True)  # disabled
number_slider_61 = Slider(0.003, range=0..0.1)  # disabled
number_slider_62 = Slider(0.029, range=0..0.1)  # disabled
number_slider_63 = Slider(0.006, range=0..0.1)  # disabled
number_slider_64 = Slider(0.059, range=0..0.23)  # disabled
number_slider_65 = Slider(0.009, range=0..0.1)  # disabled
item_79 = ListItem(List=join_8, Index=0, Wrap=True)  # disabled
neg_4 = Negative(Value=number_slider_63)  # disabled
Z_9 = UnitZ(Factor=number_slider_62)  # disabled
offset = OffsetCurve(Curve=item_79, Distance=neg_4, Plane=PlaneXY(0, 0, 0), Corners=1)  # -> flatten(Curve); disabled
Z_10 = UnitZ(Factor=number_slider_64)  # disabled
Z_11 = UnitZ(Factor=number_slider_65)  # disabled
neg_5 = Negative(Value=Z_9)  # disabled
move_11 = Move(Geometry=offset, Motion=Z_11)  # -> Geometry, Transform; disabled
neg_6 = Negative(Value=Z_10)  # disabled
move_12 = Move(Geometry=basic_triangle_4, Motion=neg_6)  # -> Geometry, Transform; disabled
loft_opt = LoftOptions(Closed=False, Adjust=False, Rebuild=0, Refit=0, Type=0)  # disabled
loft_6 = Loft(
    Curves=flatten([item_79, move_11.Geometry]),
    Options={Adjust=False, Closed=False, LoftEnds=0, LoftSimp=0, LoftType=0, Rebuild=10, Refit=0.01})  # disabled
move_13 = Move(Geometry=join_7, Motion=neg_6)  # -> Geometry, Transform; disabled
loft_7 = Loft(Options={Adjust=False, Closed=False, LoftEnds=0, LoftSimp=0, LoftType=0, Rebuild=10, Refit=0.01})  # disabled
number_slider_66 = Slider(0.31, range=0..1)  # disabled
debrep_30 = DeconstructBrep(Brep=loft_6)  # -> Faces, Edges, Vertices; disabled
dupln = RemoveDuplicateLines(Lines=debrep_30.Edges, Tolerance=0.01)  # disabled
len_12 = Length(Curve=dupln)  # disabled
sort_4 = SortList(Keys=len_12, ValuesA=dupln)  # -> Keys, ValuesA; disabled
split = SplitList(List=sort_4.ValuesA, Index=6)  # -> ListA, ListB; disabled
end = EndPoints(Curve=split.ListA)  # -> Start, End; disabled
alongcrv = SortAlongCurve(Points=end.Start, Curve=item_79)  # -> Points, Indices; disabled
item_80 = ListItem(List=split.ListA, Index=alongcrv.Indices, Wrap=True)  # disabled
item_81 = ListItem(List=item_5, Index=0, Wrap=True)  # disabled
height_profile = Slider(0.016, range=0.001..0.1)  # disabled
curvepoint = PointOnCurve(item_81, parameter=0.5)  # disabled
Z_12 = UnitZ(Factor=height_profile)  # disabled
Y_2 = UnitY(Factor=height_profile)  # disabled
neg_7 = Negative(Value=Z_12)  # disabled
move_14 = Move(Geometry=curvepoint, Motion=[Y_2, neg_7])  # -> Geometry, Transform; disabled
item_82 = ListItem(List=move_14.Geometry, Index=1, Wrap=True)  # disabled
item_83 = ListItem(List=move_14.Geometry, Index=0, Wrap=True)  # disabled
bezier_strength = Slider(0.013, range=0.001..0.1)  # disabled
profile_thickness = Slider(0.001, range=0.001..0.1)  # disabled
Y_3 = UnitY(Factor=bezier_strength)  # disabled
neg_8 = Negative(Value=Y_3)  # disabled
Z_13 = UnitZ(Factor=bezier_strength)  # disabled
Z_14 = UnitZ(Factor=profile_thickness)  # disabled
Y_4 = UnitY(Factor=profile_thickness)  # disabled
neg_9 = Negative(Value=Z_14)  # disabled
number_slider_67 = Slider(0.001, range=0.001..0.1)  # disabled
ln_8 = Line(StartPoint=item_82, EndPoint=curvepoint)  # disabled
ln_9 = Line(StartPoint=item_83, EndPoint=curvepoint)  # disabled
move_15 = Move(Geometry=item_83, Motion=neg_9)  # -> Geometry, Transform; disabled
move_16 = Move(Geometry=item_82, Motion=Y_4)  # -> Geometry, Transform; disabled
bzspan = BezierSpan(StartPoint=move_15.Geometry, StartTangent=neg_8, EndPoint=move_16.Geometry, EndTangent=Z_13)  # -> flatten(Curve), Length, Domain; disabled
join_22 = JoinCurves(Curves=[ln_9, ln_8], Preserve=False)  # -> flatten(Curves); disabled
fillet = Fillet(Curve=join_22, Radius=number_slider_67)  # -> flatten(Curve); disabled
relay = Relay()  # disabled
connect = ConnectCurves(Curves=[bzspan.Curve, join_22], Continuity=2, Close=True, Bulge=1)  # -> flatten(Curve); disabled
number_slider_68 = Slider(0.815, range=0.8..1)  # disabled
area_23 = Area(Geometry=relay)  # -> Area, Centroid; disabled
arrpolar = PolarArray(Geometry=connect, Plane=PlaneXY(0, 0, 0), Count=3, Angle=6.283185307)  # -> Geometry, Transform; disabled
scale_14 = Scale(Geometry=relay, Center=area_23.Centroid, Factor=number_slider_68)  # -> Geometry, Transform; disabled

# ---- group: ALTERNATIVE MODELS / bottom inset (continued)
area_24 = Area(Geometry=move_12.Geometry)  # -> Area, Centroid; disabled
scale_15 = Scale(Geometry=move_12.Geometry, Center=area_24.Centroid, Factor=number_slider_37)  # -> Geometry, Transform; disabled
explode_18 = Explode(Curve=scale_15.Geometry, Recursive=True)  # -> Segments, Vertices; disabled
item_84 = ListItem(List=explode_18.Segments, Index=0, Wrap=True)  # disabled
len_13 = Length(Curve=item_84)  # disabled
dom_10 = ConstructDomain(DomainStart=0, DomainEnd=len_13)  # disabled
remap_15 = RemapNumbers(Value=subtraction_8, Source=Domain(0, 1), Target=dom_10)  # -> Mapped, Clipped; disabled
remap_16 = RemapNumbers(Value=number_slider_38, Source=Domain(0, 1), Target=dom_10)  # -> Mapped, Clipped; disabled
shatter_8 = Shatter(Curve=explode_18.Segments, Parameters=[remap_16.Mapped, remap_15.Mapped])  # disabled
item_85 = ListItem(List=shatter_8, Index=1, Wrap=True)  # -> flatten(Item); disabled
explode_19 = Explode(Curve=item_85, Recursive=True)  # -> flatten(Segments), flatten(Vertices); disabled
cps_8 = ClosestPoints(Point=explode_19.Vertices, Cloud=explode_19.Vertices, Count=2)  # -> ClosestPoint, CPIndex, Distance; disabled
item_86 = ListItem(List=cps_8.ClosestPoint, Index=1, Wrap=True)  # -> flatten(Item); disabled
ln_10 = Line(StartPoint=explode_19.Vertices, EndPoint=item_86)  # -> flatten(Line); disabled
join_23 = JoinCurves(Curves=[item_85, ln_10], Preserve=False)  # -> flatten(Curves); disabled

# ---- group: ALTERNATIVE MODELS (continued)
item_87 = ListItem(List=join_23, Index=0, Wrap=True)  # disabled
offset_2 = OffsetCurve(Curve=item_87, Distance=number_slider_61, Plane=PlaneXY(0, 0, 0), Corners=1)  # -> flatten(Curve); disabled
move_17 = Move(Geometry=offset_2, Motion=neg_5)  # -> Geometry, Transform; disabled
loft_8 = Loft(
    Curves=[item_87, move_17.Geometry],
    Options={Adjust=False, Closed=False, LoftEnds=0, LoftSimp=0, LoftType=0, Rebuild=10, Refit=0.01})  # disabled
debrep_31 = DeconstructBrep(Brep=loft_8)  # -> Faces, Edges, Vertices; disabled
dupln_2 = RemoveDuplicateLines(Lines=debrep_31.Edges, Tolerance=0.01)  # disabled
len_14 = Length(Curve=dupln_2)  # disabled
sort_5 = SortList(Keys=len_14, ValuesA=debrep_31.Edges)  # -> Keys, ValuesA; disabled
split_2 = SplitList(List=sort_5.ValuesA, Index=6)  # -> ListA, ListB; disabled
geo_8 = Geometry([split.ListA, split_2.ListA])  # disabled
end_2 = EndPoints(Curve=split_2.ListA)  # -> Start, End; disabled
alongcrv_2 = SortAlongCurve(Points=end_2.Start, Curve=item_87)  # -> Points, Indices; disabled
item_88 = ListItem(List=split_2.ListA, Index=alongcrv_2.Indices, Wrap=True)  # disabled
merge_10 = Merge(Data1=move_11.Geometry, Data2=item_79, Data3=item_87, Data4=move_17.Geometry)  # disabled
blendc = BlendCurve(CurveA=item_80, CurveB=item_88, BulgeA=number_slider_66, BulgeB=number_slider_66, Continuity=2)  # disabled
geo_9 = Geometry([item_79, move_11.Geometry, item_87, move_17.Geometry])  # disabled
netsurf = NetworkSurface(CurvesU=flatten(merge_10), CurvesV=flatten(blendc), Continuity=3)  # disabled

# ---- group: pyras locations
crv = Curve(<curve referenced from the Rhino model>)  # disabled
bbox = BoundingBox(Content=crv, Plane=PlaneXY(0, 0, 0))  # -> Box, Box_2; disabled
bbox_scale = Slider(1.06, range=0.8..1.2)  # disabled
boxprop = BoxProperties(Box=bbox.Box)  # -> Center, Diagonal, Area, Volume, Degeneracy; disabled
scale_16 = Scale(Geometry=bbox.Box, Center=boxprop.Center, Factor=bbox_scale)  # -> Geometry, Transform; disabled
debox = DeconstructBox(Box=scale_16.Geometry)  # -> Plane, X, Y, Z; disabled
vec = VectorXYZ(XComponent=debox.X, YComponent=0, ZComponent=0)  # -> Vector, Length; disabled
division = Division(A=vec.Length, B=2)  # disabled
debrep_32 = DeconstructBrep(Brep=scale_16.Geometry)  # -> Faces, Edges, Vertices; disabled
neg_10 = Negative(Value=division)  # disabled
item_89 = ListItem(List=debrep_32.Vertices, Index=0, Wrap=True)  # disabled
multiplication_7 = Multiplication(A=vec.Length, B=2)  # disabled
line = LineSDL(Start=item_89, Direction=vec.Vector, Length=multiplication_7)  # disabled
X = UnitX(Factor=neg_10)  # disabled
vec_2 = VectorXYZ(XComponent=0, YComponent=debox.Y, ZComponent=0)  # -> Vector, Length; disabled
move_18 = Move(Geometry=line, Motion=X)  # -> Geometry, Transform; disabled
eval = Evaluate(F="x/cos(Rad(30))", x=vec_2.Length)  # disabled

# ---- group: generating mother pyra and moving them where they belong. thats right. you heard me. move to where you belong. bad pyramid.
pt = ConstructPoint(XCoordinate=0, YCoordinate=0, ZCoordinate=0)  # disabled
# universal pyra
pt_2 = ConstructPoint(XCoordinate=1, YCoordinate=0, ZCoordinate=0)  # disabled
vec2pt_10 = Vector2Pt(PointA=pt, PointB=pt_2, Unitize=False)  # -> Vector, Length; disabled
Z_15 = UnitZ(Factor=1)  # disabled
Z_16 = UnitZ(Factor=1)  # disabled
panel_7 = Panel("120")  # disabled
panel_8 = Panel("60")  # disabled
vrot = Rotate(Vector=vec2pt_10.Vector, Axis=Z_15, Angle=degrees(panel_7))  # disabled
vrot_2 = Rotate(Vector=vec2pt_10.Vector, Axis=Z_16, Angle=degrees(panel_8))  # disabled
srf4pt_2 = _4PointSurface(CornerA=pt, CornerB=vrot, CornerC=vrot_2)  # disabled
pcen = PolygonCenter(Polyline=srf4pt_2)  # -> CenterV, CenterE, CenterA; disabled
vec2pt_11 = Vector2Pt(PointA=pcen.CenterV, PointB=pt, Unitize=False)  # -> Vector, Length; disabled
move_19 = Move(Geometry=srf4pt_2, Motion=vec2pt_11.Vector)  # -> Geometry, Transform; disabled
pcen_2 = PolygonCenter(Polyline=move_19.Geometry)  # -> CenterV, CenterE, CenterA; disabled
Z_17 = UnitZ(Factor=1)  # disabled
panel_9 = Panel("180")  # disabled
rot3d_2 = Rotate3D(Geometry=move_19.Geometry, Angle=degrees(panel_9), Center=pcen_2.CenterV, Axis=Z_17)  # -> Geometry, Transform; disabled
explode_20 = Explode(Curve=rot3d_2.Geometry, Recursive=True)  # -> Segments, Vertices; disabled
item_90 = ListItem(List=explode_20.Vertices, Index=0, Wrap=True)  # disabled
Z_18 = UnitZ(Factor=1)  # disabled
sph_2 = Sphere(Base=PlaneXY(0, 0, 0), Radius=1)  # disabled
project = ProjectPoint(Point=item_90, Direction=Z_18, Geometry=sph_2)  # -> Point, Index; disabled
pdecon = Deconstruct(Point=project.Point)  # -> XComponent, YComponent, ZComponent; disabled
division_2 = Division(A=pdecon.ZComponent, B=2)  # disabled
neg_11 = Negative(Value=division_2)  # disabled
number_slider_69 = Slider(1.8, range=0.1..5)  # disabled
Z_19 = UnitZ(Factor=neg_11)  # disabled
Z_20 = UnitZ(Factor=division_2)  # disabled
move_20 = Move(Geometry=move_19.Geometry, Motion=Z_19)  # -> Geometry, Transform; disabled
move_21 = Move(Geometry=rot3d_2.Geometry, Motion=Z_20)  # -> Geometry, Transform; disabled
scale_17 = Scale(Geometry=move_20.Geometry, Center=Point(0, 0, 0), Factor=number_slider_69)  # -> flatten(Geometry), Transform; disabled
scale_18 = Scale(Geometry=move_21.Geometry, Center=Point(0, 0, 0), Factor=number_slider_69)  # -> flatten(Geometry), Transform; disabled
cluster = Cluster(B=scale_18.Geometry, B_2=scale_17.Geometry)  # -> flatten(_1), flatten(_2), flatten(_3), flatten(_4), flatten(_5), flatten(_6); disabled
geo_10 = Geometry([cluster._1, cluster._2, cluster._3, cluster._4, cluster._5, cluster._6, scale_17.Geometry, scale_18.Geometry])  # disabled
join_24 = BrepJoin(Breps=geo_10)  # -> Breps, Closed; disabled

# ---- group: pyras locations (continued)
multiplication_8 = Multiplication(A=number_slider_69, B=2)  # disabled
divlength = DivideLength(Curve=move_18.Geometry, Length=multiplication_8)  # -> Points, Tangents, Parameters; disabled
line_2 = LineSDL(Start=divlength.Points, Direction=vrot, Length=eval)  # -> flatten(Line); disabled
line_3 = LineSDL(Start=divlength.Points, Direction=vrot_2, Length=eval)  # -> flatten(Line); disabled
montecarlo_pattern = Geometry([line_3, line_2])  # disabled
trim_2 = TrimWithRegion(Curve=montecarlo_pattern, Region=crv)  # -> flatten(Inside), Outside; disabled
mcx = MultipleCurves(Curves=trim_2.Inside)  # -> Points, IndexA, IndexB, ParamA, ParamB; disabled
geo_11 = Geometry(trim_2.Inside)  # disabled

# ---- group: structural input data gathering
dedomain = DeconstructDomain(Domain=debox.X)  # -> Start, End; disabled
pdecon_2 = Deconstruct(Point=mcx.Points)  # -> XComponent, YComponent, ZComponent; disabled
sort_val = SortDuplicateValues(ValueList=pdecon_2.YComponent)  # -> UniqueValues, Indices; disabled
pt_3 = ConstructPoint(XCoordinate=dedomain.End, YCoordinate=sort_val.UniqueValues, ZCoordinate=0)  # disabled
pt_4 = ConstructPoint(XCoordinate=dedomain.Start, YCoordinate=sort_val.UniqueValues, ZCoordinate=0)  # disabled
ln_11 = Line(StartPoint=pt_4, EndPoint=pt_3)  # disabled
trim_3 = TrimWithRegion(Curve=ln_11, Region=crv)  # -> Inside, Outside; disabled
geo_12 = Geometry(flatten([trim_3.Inside, geo_11]))  # disabled
list_goodies_7 = CSharpScript(x=geo_12)  # -> out, sum, flatten(max), min, avg; inputs x: list of Double; disabled; same code as list_goodies
area_25 = Area(Geometry=crv)  # -> Area, Centroid; disabled

# ---- group: generating mother pyra and moving them where they belong. thats right. you heard me. move to where you belong. bad pyramid. (continued)
vec2pt_12 = Vector2Pt(PointA=pt, PointB=mcx.Points, Unitize=False)  # -> flatten(Vector), Length; disabled
move_22 = Move(Geometry=join_24.Breps, Motion=vec2pt_12.Vector)  # -> Geometry, Transform; disabled
debrep_33 = DeconstructBrep(Brep=move_22.Geometry)  # -> Faces, flatten(Edges), Vertices; disabled

# ---- group: find me those triangle midpoints.
cps_9 = ClosestPoints(Point=mcx.Points, Cloud=mcx.Points, Count=7)  # -> simplify(ClosestPoint), CPIndex, Distance; disabled
relay_2 = DataDescription(mcx.Points)  # disabled
relay_3 = DataDescription(mcx.Points)  # disabled
dist_4 = Distance(PointA=graft(relay_3), PointB=cps_9.ClosestPoint)  # -> simplify(Distance); disabled
closest_point = DataDescription(cps_9.ClosestPoint)  # disabled
replace = ReplaceItems(List=dist_4, Indices=0, Wrap=False)  # disabled
multiplication_9 = Multiplication(A=number_slider_69, B=2)  # disabled
closest_point_2 = ClosestPoint(closest_point)  # disabled
replace_2 = ReplaceItems(List=closest_point_2, Indices=0, Wrap=False)  # disabled
clean_11 = CleanTree(RemoveNulls=True, RemoveInvalid=True, RemoveEmpty=False, Tree=replace)  # -> simplify(Tree); disabled
addition = Addition(A=multiplication_9, B=0.1)  # disabled
clean_12 = CleanTree(RemoveNulls=True, RemoveInvalid=True, RemoveEmpty=False, Tree=replace_2)  # -> simplify(Tree); disabled
smaller = SmallerThan(FirstNumber=clean_11, SecondNumber=addition)  # -> SmallerThan, OrEqualTo; disabled
sift_12 = SiftPattern(List=clean_12, SiftPattern=smaller.SmallerThan)  # -> Output0, Output1; disabled
clean_13 = CleanTree(RemoveNulls=True, RemoveInvalid=True, RemoveEmpty=False, Tree=sift_12.Output1)  # disabled
geo_13 = Geometry(graft(relay_2))  # disabled
ln_12 = Line(StartPoint=geo_13, EndPoint=clean_13)  # -> flatten(Line); disabled
dupln_3 = RemoveDuplicateLines(Lines=ln_12, Tolerance=0.01)  # -> flatten(UniqueLines); disabled
wbweave = WeaverbirdsMeshFromLinesWeaveBack(Lines=dupln_3, MaximumValence=3)  # disabled
wbfacepolys = WeaverbirdsFacePolylines(Mesh=wbweave)  # disabled
pcen_3 = PolygonCenter(Polyline=wbfacepolys)  # -> flatten(CenterV), CenterE, CenterA; disabled

# ---- group: make triangle meshes to connect pyras
debrep_34 = DeconstructBrep(Brep=move_22.Geometry)  # -> Faces, Edges, flatten(Vertices); disabled
cps_10 = ClosestPoints(Point=pcen_3.CenterV, Cloud=debrep_34.Vertices, Count=3)  # -> simplify(ClosestPoint), CPIndex, Distance; disabled
item_91 = ListItem(List=cps_10.ClosestPoint, Index=2, Wrap=True)  # -> flatten(Item); disabled
item_92 = ListItem(List=cps_10.ClosestPoint, Index=1, Wrap=True)  # -> flatten(Item); disabled
item_93 = ListItem(List=cps_10.ClosestPoint, Index=0, Wrap=True)  # -> flatten(Item); disabled
srf4pt_3 = _4PointSurface(CornerA=item_92, CornerB=item_93, CornerC=item_91)  # disabled
debrep_35 = DeconstructBrep(Brep=srf4pt_3)  # -> Faces, flatten(Edges), Vertices; disabled
wbweave_2 = WeaverbirdsMeshFromLinesWeaveBack(Lines=debrep_35.Edges, MaximumValence=3)  # disabled

# ----
# main model
item_94 = ListItem(List=srf4pt_3, Index=0, Wrap=True)  # disabled
area_26 = Area(Geometry=item_94)  # -> Area, Centroid; disabled
vec2pt_13 = Vector2Pt(PointA=area_26.Centroid, PointB=Point(0, 0, 0), Unitize=False)  # -> Vector, Length; disabled
move_23 = Move(Geometry=item_94, Motion=vec2pt_13.Vector)  # -> Geometry, Transform; disabled

# ---- group: anchors / alldias
debrep_36 = DeconstructBrep(Brep=move_22.Geometry)  # -> Faces, Edges, flatten(Vertices); disabled

# ---- group: anchors
wbnaked_3 = WeaverbirdsNakedBoundary(MeshClosedPolylines=wbweave)  # disabled
move_24 = Move(Geometry=wbnaked_3, Motion=Z_19)  # -> Geometry, Transform; disabled
crv_cp_4 = CurveClosestPoint(Point=flatten(mcx.Points), Curve=wbnaked_3)  # -> Point, Parameter, flatten(Distance); disabled
relay_4 = DataDescription(mcx.Points)  # disabled
panel_10 = Panel("0.1")  # disabled
smaller_2 = SmallerThan(FirstNumber=crv_cp_4.Distance, SecondNumber=panel_10)  # -> SmallerThan, OrEqualTo; disabled
equals_2 = Equality(FirstNumber=crv_cp_4.Distance, SecondNumber=0)  # -> Equality, Inequality; disabled
geometry = DataDescription(move_24.Geometry)  # disabled
pcen_4 = PolygonCenter(Polyline=move_24.Geometry)  # -> CenterV, CenterE, CenterA; disabled
scale_outmost_curve = Slider(1.108, range=0.95..1.3)  # disabled
sift_13 = SiftPattern(List=relay_4, SiftPattern=smaller_2.SmallerThan)  # -> Output0, Output1; disabled
scale_19 = Scale(Geometry=geometry, Center=pcen_4.CenterV, Factor=scale_outmost_curve)  # -> Geometry, Transform; disabled
geo_14 = Geometry(sift_13.Output1)  # disabled
clean_14 = CleanTree(RemoveNulls=True, RemoveInvalid=True, RemoveEmpty=False, Tree=geo_14)  # disabled
cps_11 = ClosestPoints(Point=clean_14, Cloud=debrep_36.Vertices, Count=6)  # -> simplify(ClosestPoint), CPIndex, Distance; disabled
closest_point_3 = DataDescription(flatten(cps_11.ClosestPoint))  # disabled

# ---- group: find anchor points
pdecon_3 = Deconstruct(Point=closest_point_3)  # -> XComponent, YComponent, ZComponent; disabled
cset = CreateSet(List=pdecon_3.ZComponent)  # -> Set, Map; disabled
mindex = MemberIndex(Set=pdecon_3.ZComponent, Member=cset.Set)  # -> Index, Count; disabled
sort_6 = SortList(Keys=mindex.Count)  # -> reverse(Keys), ValuesA; disabled
item_95 = ListItem(List=sort_6.Keys, Index=0, Wrap=True)  # disabled
int = Integer(item_95)  # disabled
mindex_2 = MemberIndex(Set=mindex.Count, Member=int)  # -> Index, Count; disabled
item_96 = ListItem(List=cset.Set, Index=mindex_2.Index, Wrap=True)  # disabled
smaller_3 = SmallerThan(FirstNumber=item_96, SecondNumber=0)  # -> SmallerThan, OrEqualTo; disabled
dispatch = Dispatch(List=item_96, DispatchPattern=smaller_3.SmallerThan)  # -> ListA, ListB; disabled
smaller_4 = SmallerThan(FirstNumber=pdecon_3.ZComponent, SecondNumber=dispatch.ListA)  # -> SmallerThan, OrEqualTo; disabled
dispatch_2 = Dispatch(List=closest_point_3, DispatchPattern=smaller_4.OrEqualTo)  # -> ListA, ListB; disabled
geo_15 = Geometry(dispatch_2.ListA)  # disabled
incurve = PointInCurve(Point=flatten(geo_15), Curve=flatten(geometry))  # -> flatten(Relationship), Point; disabled
num = Number(incurve.Relationship)  # disabled
larger_7 = LargerThan(FirstNumber=num, SecondNumber=1)  # -> LargerThan, OrEqualTo; disabled
dispatch_3 = Dispatch(List=flatten(geo_15), DispatchPattern=larger_7.LargerThan)  # -> ListA, ListB; disabled
geo_16 = Geometry(dispatch_3.ListA)  # disabled
geo_17 = Geometry(dispatch_3.ListB)  # disabled

# ---- group: approximate anchor point position of anchors that are distant from edge curve
alongcrv_3 = SortAlongCurve(Points=geo_17, Curve=scale_19.Geometry)  # -> Points, Indices; disabled
explode_21 = Explode(Curve=crv, Recursive=True)  # -> Segments, Vertices; disabled
number_slider_70 = Slider(0, range=0..120)  # disabled
number_slider_71 = Slider(23, range=0..120)  # disabled
number_slider_72 = Slider(24, range=0..120)  # disabled
number_slider_73 = Slider(43, range=0..120)  # disabled
number_slider_74 = Slider(44, range=0..120)  # disabled
number_slider_75 = Slider(58, range=0..120)  # disabled
number_slider_76 = Slider(59, range=0..120)  # disabled
number_slider_77 = Slider(86, range=0..120)  # disabled
dom_11 = ConstructDomain(DomainStart=number_slider_70, DomainEnd=number_slider_71)  # disabled
dom_12 = ConstructDomain(DomainStart=number_slider_72, DomainEnd=number_slider_73)  # disabled
dom_13 = ConstructDomain(DomainStart=number_slider_74, DomainEnd=number_slider_75)  # disabled
dom_14 = ConstructDomain(DomainStart=number_slider_76, DomainEnd=number_slider_77)  # disabled
subset = SubList(List=alongcrv_3.Points, Domain=dom_11, Wrap=True)  # -> flatten(List), Index; disabled
subset_2 = SubList(List=alongcrv_3.Points, Domain=dom_12, Wrap=True)  # -> flatten(List), Index; disabled
subset_3 = SubList(List=alongcrv_3.Points, Domain=dom_13, Wrap=True)  # -> flatten(List), Index; disabled
subset_4 = SubList(List=alongcrv_3.Points, Domain=dom_14, Wrap=True)  # -> flatten(List), Index; disabled
panel_11 = Panel("2")  # disabled
panel_12 = Panel("3")  # disabled
panel_13 = Panel("1")  # disabled
panel_14 = Panel("0")  # disabled
item_97 = ListItem(List=explode_21.Segments, Index=panel_14, Wrap=True)  # disabled
item_98 = ListItem(List=explode_21.Segments, Index=panel_13, Wrap=True)  # disabled
item_99 = ListItem(List=explode_21.Segments, Index=panel_11, Wrap=True)  # disabled
item_100 = ListItem(List=explode_21.Segments, Index=panel_12, Wrap=True)  # disabled
number_slider_78 = Slider(-33, range=-90..90)  # disabled
number_slider_79 = Slider(-40, range=-90..90)  # disabled
number_slider_80 = Slider(-28, range=-90..90)  # disabled
number_slider_81 = Slider(0, range=-90..90)  # disabled
curvepoint_2 = PointOnCurve(item_97, parameter=0.5)  # disabled
curvepoint_3 = PointOnCurve(item_98, parameter=0.5)  # disabled
curvepoint_4 = PointOnCurve(item_99, parameter=0.5)  # disabled
curvepoint_5 = PointOnCurve(item_100, parameter=0.5)  # disabled
rot3d_3 = Rotate3D(Geometry=subset.List, Angle=degrees(number_slider_78), Center=curvepoint_2, Axis=item_97)  # -> Geometry, Transform; disabled
rot3d_4 = Rotate3D(Geometry=subset_2.List, Angle=degrees(number_slider_79), Center=curvepoint_3, Axis=item_98)  # -> Geometry, Transform; disabled
rot3d_5 = Rotate3D(Geometry=subset_3.List, Angle=degrees(number_slider_80), Center=curvepoint_4, Axis=item_99)  # -> Geometry, Transform; disabled
rot3d_6 = Rotate3D(Geometry=subset_4.List, Angle=degrees(number_slider_81), Center=curvepoint_5, Axis=item_100)  # -> Geometry, Transform; disabled
merge_11 = Merge(Data1=rot3d_3.Geometry, Data2=rot3d_4.Geometry, Data3=rot3d_5.Geometry, Data4=rot3d_6.Geometry)  # -> flatten(Result); disabled

# ---- group: australian magic
trias = Geometry(wbweave_2)  # disabled
wbweave_3 = WeaverbirdsMeshFromLinesWeaveBack(Lines=[debrep_33.Edges, debrep_35.Edges], MaximumValence=3)  # disabled
demesh_4 = DeconstructMesh(Mesh=trias)  # -> Vertices, Faces, Colours, Normals; disabled
wbedges_6 = WeaverbirdsMeshEdges(MeshOrPolylines=wbweave_3)  # disabled
mesh_9 = DataDescription(wbweave_3)  # disabled
explode_22 = Explode(Curve=wbedges_6, Recursive=True)  # -> Segments, Vertices; disabled
deface_2 = DeconstructFace(Face=demesh_4.Faces)  # -> CornerA, CornerB, CornerC, CornerD; disabled
vertices = DataDescription(demesh_4.Vertices)  # disabled
vertices_2 = DataDescription(demesh_4.Vertices)  # disabled
lines = DataDescription(wbedges_6)  # disabled
lines_2 = DataDescription(wbedges_6)  # disabled
vertices_3 = DataDescription(demesh_4.Vertices)  # disabled
number_slider_82 = Slider(1000, range=1000..5000)  # disabled
number_slider_83 = Slider(20, range=0..100)  # disabled
dupln_4 = RemoveDuplicateLines(Lines=explode_22.Segments, Tolerance=0.01)  # disabled
item_101 = ListItem(List=vertices_3, Index=deface_2.CornerB, Wrap=True)  # disabled
item_102 = ListItem(List=vertices, Index=deface_2.CornerA, Wrap=True)  # disabled
item_103 = ListItem(List=vertices_2, Index=deface_2.CornerC, Wrap=True)  # disabled
len_15 = Length(Curve=lines_2)  # disabled
lines_3 = Lines(lines)  # disabled
springs_4 = SpringsFromLine(
    Connection=lines_3,
    Stiffness=number_slider_82,
    Damping=10,
    RestLength=len_15,
    UpperCutoff=0,
    LowerCutoff=0,
    Plasticity=0)  # disabled
areaweight = AreaWeight(P0=item_102, P1=item_101, P2=item_103, Weight=number_slider_83, Cotan=True)  # disabled
# saved state to anchors 000 before resetting the model my friend.
button_2 = Button()  # disabled
merge_12 = Merge(Data1=springs_4, Data2=areaweight)  # -> flatten(Result); disabled
mesh_10 = Mesh(mesh_9)  # disabled
kangaroo_2 = KangarooPhysics(ForceObjects=merge_12, AnchorPoints=flatten(merge_11), Settings=null, Geometry=mesh_10, SimulationReset=button_2)  # -> Out, Iterations, ParticlesOut, GeometryOut, KE; disabled
timer_2 = Timer(TimerInterval=20, Target=kangaroo_2)  # disabled
geo_18 = Geometry(kangaroo_2.GeometryOut)  # disabled
bbox_2 = BoundingBox(Content=geo_18, Plane=PlaneXY(0, 0, 0))  # -> Box, Box_2; disabled
boxprop_2 = BoxProperties(Box=bbox_2.Box)  # -> Center, Diagonal, Area, Volume, Degeneracy; disabled
devec = DeconstructVector(Vector=boxprop_2.Diagonal)  # -> XComponent, YComponent, ZComponent; disabled
height = Panel(devec.ZComponent)  # disabled

# ----
wbvertices_3 = WeaverbirdsVerticesComponent(MeshClosedPolylinesGroup=geo_18, Weld=True)  # -> simplify(flatten(Points)); disabled
wbedges_7 = WeaverbirdsMeshEdges(MeshOrPolylines=geo_18)  # disabled
division_3 = Division(A=area_25.Area, B=list_goodies_7.sum)  # disabled
flächenlast_kn_m2 = Slider(1, range=0..5)  # disabled
m2_oberfläche_m_stablänge = Panel(division_3)  # disabled
cp = ClosestPoint(Point=merge_11, Cloud=wbvertices_3)  # -> ClosestPoint, CPIndex, Distance; disabled
geo_19 = Geometry(cp.ClosestPoint)  # disabled
len_16 = Length(Curve=wbedges_7)  # -> flatten(Length); disabled
multiplication_10 = Multiplication(A=m2_oberfläche_m_stablänge, B=flächenlast_kn_m2)  # disabled
panel_15 = Panel("{0.0,0.0,-1.0}")  # disabled
panel_16 = Panel("a")  # disabled
number_slider_84 = Slider(1, range=0..4)  # disabled
number_slider_85 = Slider(6.5, range=0..30)  # disabled
list_goodies_8 = CSharpScript(x=len_16)  # -> out, sum, flatten(max), min, avg; inputs x: list of Double; disabled
# ---------- list_goodies_8: C# ----------
    double sumx = 0;
    double maxx = 0;
    double minx = 1;
    double counter = 0;

    foreach (double t in x)
    {
      sumx += t;
      counter += 1;
      if (t > maxx)
        maxx = t;
      else if (t < minx )
        minx = t;
    }

    sum = sumx;
    max = maxx;
    min = minx;
    avg = sumx / counter;
# ---------- end list_goodies_8 ----------
amp = Amplitude(Vector=panel_15, Amplitude=multiplication_10)  # disabled
linetobeam = LineToBeamKaramba(Point=flatten(wbvertices_3), Line=flatten(wbedges_7), New=True, Remove=True, LDist=0.005, Identifier=panel_16)  # -> Point, Beam, Info; disabled
cross_sections = CrossSectionsKaramba(ElementsIdentifiers=panel_16, Diameter_cm=number_slider_85, WallThickness_cm=number_slider_84, mode="Circular Hollow")  # disabled
avg_beam_length = Panel(list_goodies_8.avg)  # disabled
loads = LoadsKaramba(Vector=amp, BeamIdentifierS=panel_16, LCase=0, mode="Uniform Line", menu=[buttons(off, on, off)])  # disabled
panel_17 = Panel("{0.0,0.0,-1.0}")  # disabled
pt_5 = Point(geo_19)  # disabled
supp = SupportKaramba(PosInd=pt_5, menu=[buttons(on, on, on, off, off, off)])  # disabled
matselect = MaterialSelectionKaramba3D(menu=[dropdown(2), dropdown(3)])  # disabled
loads_2 = LoadsKaramba(Vector=panel_17, LCase=0, mode="Gravity")  # disabled
load = LoadKaramba(flatten([loads_2, loads]))  # disabled
assemble = AssembleModelKaramba(
    Point=linetobeam.Point,
    Elem=linetobeam.Beam,
    Support=supp,
    Load=load,
    CrossSection=cross_sections,
    Material=matselect,
    LDist=0.005)  # -> Model, Info, Mass, CenterOfGravity; disabled
analyzethi = AnalyzeThIKaramba(Model=assemble.Model)  # -> ModelWithDisplacements, MaximumDisplacement_m, ResultingForceOfGravity_kN, ElasticEnergy_kNm; disabled
modelview = ModelViewKaramba(Model=analyzethi.ModelWithDisplacements, LoadCaseFactorsForLinearSuperposition=1, IndexIncrementOfVisibleLoadcase=0)  # -> Model, MeshOfRendering, DeformedStructure, DeformedModel; disabled
beamview = BeamViewKaramba(Model=modelview.Model)  # -> Model, MeshOfRendering, DeformedBeamAxes, LegendColors, LegendTags; disabled
utilization = UtilizationOfElementsKaramba(
    AnalyzedModel=beamview.Model,
    LoadCase=-1,
    NumberOfSamplePoints=3,
    ElasticDesign=True,
    GammaM0=1,
    GammaM1=1,
    WithDetails=False,
    mode="Beams")  # -> AnalyzedModel, Utilization, UtilN, UtilVy, UtilVz, UtilMt, UtilMy, UtilMz, Details; disabled
beamdisp = BeamDisplacementsKaramba(AnalyzedModel=beamview.Model, LoadCase=-1, MaximumDistanceBetweenResults_m=-1, NumberOfResultsPerElement=2)  # -> AnalyzedModel, flatten(Translations_m), Rotations_rad; disabled
b_res_force = BeamResultantForcesKaramba3D(AnalyzedModel=modelview.Model, LoadCase=-1, MaximumProbingDistance_m=-1, NumberOfProbingPointsPerElement=3)  # -> AnalyzedModel, NormalForce_kN, ResultantBendingMoment_kNm, ResultantShearForce_kN; disabled
nodedisp = NodalDisplacementsKaramba3D(AnalyzedModel=modelview.Model, LoadCase=0)  # -> AnalyzedModel, NodalTranslations_m, NodalRotations_rad; disabled
maxtrans = CSharpScript(x=nodedisp.NodalTranslations_m)  # -> out, uList, umax; inputs x: list of Point3d; disabled
# ---------- maxtrans: C# ----------
    Point3d origin = new Point3d(0, 0, 0);
    List<double> dispList = new List<double>();
    double disp = 0;
    double maxDisp = 0;

    foreach (Point3d tempP in x)
    {
      disp = origin.DistanceTo(tempP);
      dispList.Add(disp);
      if (disp > maxDisp)
      {
        maxDisp = disp;
      }
    }

    uList = dispList;
    umax = maxDisp;
# ---------- end maxtrans ----------
smaller_5 = SmallerThan(FirstNumber=b_res_force.NormalForce_kN, SecondNumber=0)  # -> SmallerThan, OrEqualTo; disabled
maxtrans_2 = CSharpScript(x=beamdisp.Translations_m)  # -> out, uList, umax; inputs x: list of Point3d; disabled; same code as maxtrans
l_300 = Panel(maxtrans_2.umax)  # disabled
sift_14 = SiftPattern(List=wbedges_7, SiftPattern=smaller_5.SmallerThan)  # -> Output0, Output1; disabled
zugstaebbe = Geometry(sift_14.Output0)  # disabled
viz = Mesh(beamview.MeshOfRendering)  # disabled

basic_triangle_5 = Geometry(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)
geo_20 = Geometry(debrep_8.Faces)
Z_21 = UnitZ(Factor=dist_2)
neg_12 = Negative(Value=Z_21)
number_slider_86 = Slider(7, range=0..7)
Z_22 = UnitZ(Factor=dist_2)

number_slider_87 = Slider(0.071, range=0..1)
area_27 = Area(Geometry=basic_triangle_5)  # -> Area, Centroid
scale_20 = Scale(Geometry=basic_triangle_5, Center=area_27.Centroid, Factor=Slider(0.774, range=0.7..1))  # -> Geometry, Transform
explode_23 = Explode(Curve=scale_20.Geometry, Recursive=True)  # -> Segments, Vertices
item_104 = ListItem(List=explode_23.Segments, Index=0, Wrap=True)
len_17 = Length(Curve=item_104)
dom_15 = ConstructDomain(DomainStart=0, DomainEnd=len_17)
subtraction_11 = Subtraction(A=1, B=number_slider_87)
remap_17 = RemapNumbers(Value=subtraction_11, Source=Domain(0, 1), Target=dom_15)  # -> Mapped, Clipped
remap_18 = RemapNumbers(Value=number_slider_87, Source=Domain(0, 1), Target=dom_15)  # -> Mapped, Clipped
shatter_9 = Shatter(Curve=explode_23.Segments, Parameters=[remap_18.Mapped, remap_17.Mapped])
item_105 = ListItem(List=shatter_9, Index=1, Wrap=True)  # -> flatten(Item)
explode_24 = Explode(Curve=item_105, Recursive=True)  # -> flatten(Segments), flatten(Vertices)
cps_12 = ClosestPoints(Point=explode_24.Vertices, Cloud=explode_24.Vertices, Count=2)  # -> ClosestPoint, CPIndex, Distance
item_106 = ListItem(List=cps_12.ClosestPoint, Index=1, Wrap=True)  # -> flatten(Item)
ln_13 = Line(StartPoint=explode_24.Vertices, EndPoint=item_106)  # -> flatten(Line)
join_25 = JoinCurves(Curves=[item_105, ln_13], Preserve=False)

area_28 = Area(Geometry=basic_triangle_5)  # -> Area, Centroid
number_slider_88 = Slider(0.06, range=0..1)
scale_21 = Scale(Geometry=basic_triangle_5, Center=area_28.Centroid, Factor=Slider(0.7, range=0.5..1))  # -> Geometry, Transform
explode_25 = Explode(Curve=scale_21.Geometry, Recursive=True)  # -> Segments, Vertices
item_107 = ListItem(List=explode_25.Segments, Index=0, Wrap=True)
len_18 = Length(Curve=item_107)
dom_16 = ConstructDomain(DomainStart=0, DomainEnd=len_18)
subtraction_12 = Subtraction(A=1, B=number_slider_88)
remap_19 = RemapNumbers(Value=subtraction_12, Source=Domain(0, 1), Target=dom_16)  # -> Mapped, Clipped
remap_20 = RemapNumbers(Value=number_slider_88, Source=Domain(0, 1), Target=dom_16)  # -> Mapped, Clipped
shatter_10 = Shatter(Curve=explode_25.Segments, Parameters=[remap_20.Mapped, remap_19.Mapped])
item_108 = ListItem(List=shatter_10, Index=1, Wrap=True)  # -> flatten(Item)
explode_26 = Explode(Curve=item_108, Recursive=True)  # -> flatten(Segments), flatten(Vertices)
cps_13 = ClosestPoints(Point=explode_26.Vertices, Cloud=explode_26.Vertices, Count=2)  # -> ClosestPoint, CPIndex, Distance
item_109 = ListItem(List=cps_13.ClosestPoint, Index=1, Wrap=True)  # -> flatten(Item)
ln_14 = Line(StartPoint=explode_26.Vertices, EndPoint=item_109)  # -> flatten(Line)
join_26 = JoinCurves(Curves=[item_108, ln_14], Preserve=False)

# ---- group: ALTERNATIVE MODELS
edges_7 = BrepEdges(Brep=scale_4.Geometry)  # -> flatten(Naked), Interior, NonManifold; disabled
join_27 = JoinCurves(Curves=edges_7.Naked, Preserve=False)  # -> flatten(Curves); disabled
item_110 = ListItem(Index=0, Wrap=True)  # disabled
explode_27 = Explode(Curve=item_110, Recursive=True)  # -> Segments, Vertices; disabled
item_111 = ListItem(List=explode_27.Segments, Index=0, Wrap=True)  # disabled
len_19 = Length(Curve=item_111)  # disabled
subtraction_13 = Subtraction(A=number_slider_2, B=number_slider_20)  # disabled
number_slider_89 = Slider(0.046, range=0..1)  # disabled
subtraction_14 = Subtraction(A=1, B=number_slider_89)  # disabled
item_112 = ListItem(Index=0, Wrap=True)  # disabled
dom_17 = ConstructDomain(DomainStart=0, DomainEnd=len_19)  # disabled
Z_23 = UnitZ(Factor=subtraction_13)  # disabled
move_25 = Move(Geometry=item_112, Motion=Z_23)  # -> Geometry, Transform; disabled
remap_21 = RemapNumbers(Value=subtraction_14, Source=Domain(0, 1), Target=dom_17)  # -> Mapped, Clipped; disabled
remap_22 = RemapNumbers(Value=number_slider_89, Source=Domain(0, 1), Target=dom_17)  # -> Mapped, Clipped; disabled
shatter_11 = Shatter(Curve=explode_27.Segments, Parameters=[remap_22.Mapped, remap_21.Mapped])  # disabled
loft_9 = Loft(
    Curves=[item_112, move_25.Geometry],
    Options={Adjust=False, Closed=False, LoftEnds=0, LoftSimp=0, LoftType=0, Rebuild=10, Refit=0.01})  # disabled
item_113 = ListItem(List=shatter_11, Index=1, Wrap=True)  # -> flatten(Item); disabled
cap_7 = CapHoles(Brep=loft_9)  # disabled
explode_28 = Explode(Curve=item_113, Recursive=True)  # -> flatten(Segments), flatten(Vertices); disabled
number_slider_90 = Slider(1, range=0..1)  # disabled
cps_14 = ClosestPoints(Point=explode_28.Vertices, Cloud=explode_28.Vertices, Count=2)  # -> ClosestPoint, CPIndex, Distance; disabled
item_114 = ListItem(List=cps_14.ClosestPoint, Index=1, Wrap=True)  # -> flatten(Item); disabled
ln_15 = Line(StartPoint=explode_28.Vertices, EndPoint=item_114)  # -> flatten(Line); disabled
join_28 = JoinCurves(Curves=[item_113, ln_15], Preserve=False)  # disabled
number_slider_91 = Slider(3, range=0..5)  # disabled
item_115 = ListItem(List=join_28, Index=0, Wrap=True)  # disabled
number_slider_92 = Slider(2052, range=0..5000)  # disabled
number_slider_93 = Slider(21, range=0..29)  # disabled
number_slider_94 = Slider(0.005, range=0.001..0.3)  # disabled

# ---- group: ALTERNATIVE MODELS / round panels
loft_10 = Loft(Options={Adjust=False, Closed=False, LoftEnds=0, LoftSimp=0, LoftType=0, Rebuild=10, Refit=0.01})  # disabled
cap_8 = CapHoles(Brep=loft_10)  # disabled
trim_4 = TrimSolid(Shape=cap_3, Cutters=[cap_8, cap_7])  # disabled
debrep_37 = DeconstructBrep(Brep=cap_8)  # -> Faces, Edges, Vertices; disabled
item_116 = ListItem(List=debrep_37.Faces, Index=number_slider_90, Wrap=True)  # disabled

# ----
debrep_38 = DeconstructBrep(Brep=clean_4)  # -> Faces, Edges, Vertices
item_117 = ListItem(List=debrep_38.Vertices, Index=0, Wrap=True)  # -> flatten(Item)
item_118 = ListItem(List=debrep_38.Vertices, Index=1, Wrap=True)  # -> flatten(Item)
area_29 = Area(Geometry=clean_4)  # -> Area, Centroid
pl_3pt_6 = Plane3Pt(PointA=area_29.Centroid, PointB=item_117, PointC=item_118)
vec2pt_14 = Vector2Pt(PointA=area_29.Centroid, PointB=item_117, Unitize=False)  # -> Vector, Length
debrep_39 = DeconstructBrep(Brep=basic_triangle_5)  # -> Faces, Edges, Vertices
item_119 = ListItem(List=debrep_39.Vertices, Index=0, Wrap=True)  # -> flatten(Item)
orient_8 = Orient(Geometry=item_119, Source=PlaneXY(0, 0, 0), Target=pl_3pt_6)  # -> Geometry, Transform

debrep_40 = DeconstructBrep(Brep=clean_6)  # -> Faces, Edges, Vertices
item_120 = ListItem(List=debrep_40.Vertices, Index=0, Wrap=True)  # -> flatten(Item)
item_121 = ListItem(List=debrep_40.Vertices, Index=1, Wrap=True)  # -> flatten(Item)
area_30 = Area(Geometry=clean_6)  # -> Area, Centroid
pl_3pt_7 = Plane3Pt(PointA=area_30.Centroid, PointB=item_120, PointC=item_121)
vec2pt_15 = Vector2Pt(PointA=area_30.Centroid, PointB=item_120, Unitize=False)  # -> Vector, Length
debrep_41 = DeconstructBrep(Brep=basic_triangle_5)  # -> Faces, Edges, Vertices
item_122 = ListItem(List=debrep_41.Vertices, Index=0, Wrap=True)  # -> flatten(Item)
orient_9 = Orient(Geometry=item_122, Source=PlaneXY(0, 0, 0), Target=pl_3pt_7)  # -> Geometry, Transform

item_123 = ListItem(List=join_25, Index=0, Wrap=True)
item_124 = ListItem(List=join_26, Index=0, Wrap=True)
move_26 = Move(Geometry=item_123, Motion=neg_12)  # -> Geometry, Transform
item_125 = ListItem(List=pl_3pt_7, Index=[1, 2, 4, 5], Wrap=True)
item_126 = ListItem(List=pl_3pt_7, Index=[0, 3, 6, 7], Wrap=True)
item_127 = ListItem(List=pl_3pt_6, Index=[1, 2, 4, 5], Wrap=True)
item_128 = ListItem(List=pl_3pt_6, Index=[0, 3, 6, 7], Wrap=True)
deplane = DeconstructPlane(Plane=item_126)  # -> Origin, XAxis, YAxis, ZAxis
deplane_2 = DeconstructPlane(Plane=item_127)  # -> Origin, XAxis, YAxis, ZAxis
deplane_3 = DeconstructPlane(Plane=item_128)  # -> Origin, XAxis, YAxis, ZAxis
deplane_4 = DeconstructPlane(Plane=item_125)  # -> Origin, XAxis, YAxis, ZAxis
multiplication_11 = Multiplication(A=deplane.ZAxis, B=0.01)
multiplication_12 = Multiplication(A=deplane_2.ZAxis, B=0.01)
multiplication_13 = Multiplication(A=deplane_3.ZAxis, B=0.01)
multiplication_14 = Multiplication(A=deplane_4.ZAxis, B=0.01)

boundary_6 = BoundarySurfaces(Edges=[move_26.Geometry, item_124])
mesh_11 = Mesh(boundary_6)
wbloop_4 = WeaverbirdsLoopSubdivision(MeshCurves=mesh_11, Level=Slider(3, range=0..10), SmoothNakedEdges=2)
wbedges_8 = WeaverbirdsMeshEdges(MeshOrPolylines=wbloop_4)
mesh_12 = Mesh(flatten(wbloop_4))

# ---- group: bits n bolts and pressures / inside outside sorting
item_129 = ListItem(List=flatten(mesh_12), Index=0, Wrap=True)
item_130 = ListItem(List=flatten(mesh_12), Index=1, Wrap=True)

# ---- group: bits n bolts and pressures
wbedges_9 = WeaverbirdsMeshEdges(MeshOrPolylines=mesh_12)
meshpressure_7 = MeshPressure(M=item_129, pressurelevel=Slider(8, range=0..1000))
meshpressure_8 = MeshPressure(M=item_130, pressurelevel=Slider(6, range=0..1000))
len_20 = Length(Curve=wbedges_9)
springs_5 = SpringsFromLine(
    Connection=wbedges_9,
    Stiffness=Slider(2052, range=0..5000),
    Damping=10,
    RestLength=len_20,
    UpperCutoff=0,
    LowerCutoff=0,
    Plasticity=0)
merge_13 = Merge(Data1=springs_5, Data2=meshpressure_8, Data3=meshpressure_7)  # -> flatten(Result)

# ---- group: anchors
wbnaked_4 = WeaverbirdsNakedBoundary(MeshClosedPolylines=mesh_8)  # disabled
join_29 = JoinCurves(Curves=wbnaked_4, Preserve=False)  # disabled
wbvertices_4 = WeaverbirdsVerticesComponent(MeshClosedPolylinesGroup=mesh_8, Weld=True)  # disabled

wbnaked_5 = WeaverbirdsNakedBoundary(MeshClosedPolylines=mesh_12)
join_30 = JoinCurves(Curves=wbnaked_5, Preserve=False)
wbvertices_5 = WeaverbirdsVerticesComponent(MeshClosedPolylinesGroup=mesh_12, Weld=True)

# ----
item_131 = ListItem(List=join_29, Index=0, Wrap=True)  # disabled
item_132 = ListItem(List=join_29, Index=1, Wrap=True)  # disabled
flipm = FlipMesh(Mesh=item_74, VertexNormals=True, FaceNormals=True, FaceOrientation=True)  # disabled
flipm_2 = FlipMesh(Mesh=item_73, VertexNormals=True, FaceNormals=True, FaceOrientation=True)  # disabled
crv_cp_5 = CurveClosestPoint(Point=wbvertices_4, Curve=flatten(item_132))  # -> Point, Parameter, Distance; disabled
equals_3 = Equality(FirstNumber=crv_cp_5.Distance, SecondNumber=0)  # -> Equality, Inequality; disabled
sift_15 = SiftPattern(List=wbvertices_4, SiftPattern=equals_3.Equality)  # -> Output0, Output1; disabled

# ---- group: anchors (continued)
crv_cp_6 = CurveClosestPoint(Point=wbvertices_4, Curve=flatten(item_131))  # -> Point, Parameter, Distance; disabled
equals_4 = Equality(FirstNumber=crv_cp_6.Distance, SecondNumber=0)  # -> Equality, Inequality; disabled
sift_16 = SiftPattern(List=wbvertices_4, SiftPattern=equals_4.Equality)  # -> Output0, Output1; disabled
geo_21 = Geometry([sift_16.Output1, sift_15.Output1])  # disabled

# ---- group: finest australian engine
button_3 = Button()  # disabled
kangaroo_3 = KangarooPhysics(ForceObjects=merge_9, AnchorPoints=flatten(geo_21), Settings=null, Geometry=mesh_8, SimulationReset=button_3)  # -> Out, Iterations, ParticlesOut, GeometryOut, KE; disabled
timer_3 = Timer(TimerInterval=20, Target=kangaroo_3)  # disabled
geo_22 = Geometry(flatten(kangaroo_3.GeometryOut))  # disabled

# ---- group: ALTERNATIVE MODELS (continued)
debrep_42 = DeconstructBrep(Brep=trim_4)  # -> flatten(Faces), Edges, Vertices; disabled
move_27 = Move(Geometry=item_116, Motion=Z_23)  # -> Geometry, Transform; disabled
join_31 = BrepJoin(Breps=[debrep_42.Faces, loft_10])  # -> Breps, Closed; disabled
edges_8 = BrepEdges(Brep=join_31.Breps)  # -> Naked, Interior, NonManifold; disabled
geo_23 = Geometry(edges_8.Naked)  # disabled
debrep_43 = DeconstructBrep(Brep=join_31.Breps)  # -> Faces, Edges, Vertices; disabled
item_133 = ListItem(List=debrep_43.Edges, Index=number_slider_93, Wrap=True)  # disabled

# ---- group: ALTERNATIVE MODELS / 4 m3sh calc
mesh_13 = Mesh([move_27.Geometry, item_116])  # disabled

# ---- group: ALTERNATIVE MODELS / FILLET
number_slider_95 = Slider(0.025, range=0..0.1)  # disabled
number_slider_96 = Slider(0.012, range=0.001..0.3)  # disabled
merge_14 = Merge(
    Data1=number_slider_95,
    Data2=number_slider_95,
    Data3=number_slider_95,
    Data4=number_slider_95,
    Data5=number_slider_95,
    Data6=number_slider_95,
    Data7=number_slider_94,
    Data8=number_slider_94,
    Data9=number_slider_94,
    Data10=number_slider_94,
    Data11=number_slider_94,
    Data12=number_slider_94,
    Data13=number_slider_94,
    Data14=number_slider_94,
    Data15=number_slider_94,
    Data16=number_slider_94,
    Data17=number_slider_94,
    Data18=number_slider_94,
    Data19=number_slider_96)  # disabled
panel_18 = Panel("""0
1
5
6
11
12
2
3
7
8
9
10
13
14
15
16
17
18
20""")  # disabled
filedge_8 = FilletEdge(Shape=join_31.Breps, Blend=0, Metric=0, Edges=panel_18, Radii=merge_14)  # disabled

# ----
item_134 = ListItem(List=join_30, Index=0, Wrap=True)
item_135 = ListItem(List=join_30, Index=1, Wrap=True)
flipm_3 = FlipMesh(Mesh=item_130, VertexNormals=True, FaceNormals=True, FaceOrientation=True)
flipm_4 = FlipMesh(Mesh=item_129, VertexNormals=True, FaceNormals=True, FaceOrientation=True)
crv_cp_7 = CurveClosestPoint(Point=wbvertices_5, Curve=flatten(item_135))  # -> Point, Parameter, Distance
equals_5 = Equality(FirstNumber=crv_cp_7.Distance, SecondNumber=0)  # -> Equality, Inequality
sift_17 = SiftPattern(List=wbvertices_5, SiftPattern=equals_5.Equality)  # -> Output0, Output1

# ---- group: anchors (continued)
crv_cp_8 = CurveClosestPoint(Point=wbvertices_5, Curve=flatten(item_134))  # -> Point, Parameter, Distance
equals_6 = Equality(FirstNumber=crv_cp_8.Distance, SecondNumber=0)  # -> Equality, Inequality
sift_18 = SiftPattern(List=wbvertices_5, SiftPattern=equals_6.Equality)  # -> Output0, Output1
geo_24 = Geometry([sift_18.Output1, sift_17.Output1])

# ---- group: finest australian engine
kangaroo_4 = KangarooPhysics(ForceObjects=merge_13, AnchorPoints=flatten(geo_24), Settings=null, Geometry=mesh_12, SimulationReset=Button())  # -> Out, Iterations, ParticlesOut, GeometryOut, KE
timer_4 = Timer(TimerInterval=20, Target=kangaroo_4)  # disabled
geo_25 = Geometry(flatten(kangaroo_4.GeometryOut))

# ----
geo_26 = Geometry(flatten(kangaroo_4.GeometryOut))
item_136 = ListItem(List=geo_26, Index=0, Wrap=True)

# ---- group: IN
item_137 = ListItem(List=geo_26, Index=1, Wrap=True)

# ----
orient_10 = Orient(Geometry=item_137, Source=PlaneXY(0, 0, 0), Target=pl_3pt_6)  # -> Geometry, Transform
area_31 = Area(Geometry=orient_10.Geometry)  # -> Area, Centroid
vec2pt_16 = Vector2Pt(PointA=area_31.Centroid, PointB=orient_8.Geometry, Unitize=False)  # -> Vector, Length
angle_4 = Angle(VectorA=vec2pt_14.Vector, VectorB=vec2pt_16.Vector, Plane=pl_3pt_6)  # -> Angle, Reflex
neg_13 = Negative(Value=angle_4.Angle)
rotate_3 = Rotate(Geometry=orient_10.Geometry, Angle=neg_13, Plane=pl_3pt_6)  # -> Geometry, Transform

# ---- group: OUT
move_28 = Move(Geometry=item_136, Motion=Z_22)  # -> Geometry, Transform

# ----
orient_11 = Orient(Geometry=move_28.Geometry, Source=PlaneXY(0, 0, 0), Target=pl_3pt_7)  # -> Geometry, Transform
area_32 = Area(Geometry=orient_11.Geometry)  # -> Area, Centroid
vec2pt_17 = Vector2Pt(PointA=area_32.Centroid, PointB=orient_9.Geometry, Unitize=False)  # -> Vector, Length
angle_5 = Angle(VectorA=vec2pt_15.Vector, VectorB=vec2pt_17.Vector, Plane=pl_3pt_7)  # -> Angle, Reflex
neg_14 = Negative(Value=angle_5.Angle)
rotate_4 = Rotate(Geometry=orient_11.Geometry, Angle=neg_14, Plane=pl_3pt_7)  # -> Geometry, Transform

item_138 = ListItem(List=rotate_4.Geometry, Index=[1, 2, 4, 5], Wrap=True)
mirror = Mirror(Geometry=item_138, Plane=item_125)  # -> Geometry, Transform
item_139 = ListItem(List=rotate_4.Geometry, Index=[0, 3, 6, 7], Wrap=True)
item_140 = ListItem(List=rotate_3.Geometry, Index=[1, 2, 4, 5], Wrap=True)
item_141 = ListItem(List=rotate_3.Geometry, Index=[0, 3, 6, 7], Wrap=True)
mirror_2 = Mirror(Geometry=item_140, Plane=item_127)  # -> Geometry, Transform
wbnaked_6 = WeaverbirdsNakedBoundary(MeshClosedPolylines=mirror_2.Geometry)
wbnaked_7 = WeaverbirdsNakedBoundary(MeshClosedPolylines=item_141)
wbnaked_8 = WeaverbirdsNakedBoundary(MeshClosedPolylines=item_139)
wbnaked_9 = WeaverbirdsNakedBoundary(MeshClosedPolylines=mirror.Geometry)
extr_2 = Extrude(Base=wbnaked_7, Direction=multiplication_13)
extr_3 = Extrude(Base=wbnaked_6, Direction=multiplication_12)
extr_4 = Extrude(Base=wbnaked_8, Direction=multiplication_11)
extr_5 = Extrude(Base=wbnaked_9, Direction=multiplication_14)
cap_9 = CapHoles(Brep=extr_2)
cap_10 = CapHoles(Brep=extr_3)
cap_11 = CapHoles(Brep=extr_4)
cap_12 = CapHoles(Brep=extr_5)
mesh_14 = Mesh([mirror_2.Geometry, item_141])
trim_5 = TrimSolid(Shape=scale_6.Geometry, Cutters=[cap_9, cap_10])
trim_6 = TrimSolid(Shape=cap_2, Cutters=[cap_11, cap_12])
debrep_44 = DeconstructBrep(Brep=trim_5)  # -> Faces, Edges, Vertices
debrep_45 = DeconstructBrep(Brep=trim_6)  # -> Faces, Edges, Vertices
mesh_15 = Mesh(debrep_44.Faces)
mesh_16 = Mesh(debrep_45.Faces)
mesh_17 = Mesh([mirror.Geometry, item_139])
wbfacepolys_2 = WeaverbirdsFacePolylines(Mesh=mesh_14)  # -> flatten(Polygons)
wbfacepolys_3 = WeaverbirdsFacePolylines(Mesh=mesh_17)  # -> flatten(Polygons)
boundary_7 = BoundarySurfaces(Edges=wbfacepolys_3)  # -> flatten(Surfaces)
boundary_8 = BoundarySurfaces(Edges=wbfacepolys_2)  # -> flatten(Surfaces)
merge_15 = Merge(Data1=boundary_8, Data2=debrep_44.Faces, Data3=boundary_7, Data4=debrep_45.Faces)  # -> flatten(Result)
join_32 = BrepJoin(Breps=flatten(merge_15))  # -> Breps, Closed
mesh_18 = Mesh(join_32.Breps)

# ---- group: ALTERNATIVE MODELS (continued)
wbloop_5 = WeaverbirdsLoopSubdivision(MeshCurves=mesh_13, Level=number_slider_91, SmoothNakedEdges=2)  # disabled
mesh_19 = Mesh(flatten(wbloop_5))  # disabled
debrep_46 = DeconstructBrep(Brep=filedge_8)  # -> flatten(Faces), flatten(Edges), Vertices; disabled

# ---- group: ALTERNATIVE MODELS / bits n bolts and pressures / inside outside sorting
item_142 = ListItem(List=flatten(mesh_19), Index=0, Wrap=True)  # disabled
item_143 = ListItem(List=flatten(mesh_19), Index=1, Wrap=True)  # disabled

# ---- group: ALTERNATIVE MODELS / bits n bolts and pressures
number_slider_97 = Slider(20, range=0..1000)  # disabled
number_slider_98 = Slider(4, range=0..1000)  # disabled
wbedges_10 = WeaverbirdsMeshEdges(MeshOrPolylines=mesh_19)  # disabled
meshpressure_9 = MeshPressure(M=item_142, pressurelevel=number_slider_98)  # disabled
meshpressure_10 = MeshPressure(M=item_143, pressurelevel=number_slider_97)  # disabled
len_21 = Length(Curve=wbedges_10)  # disabled
springs_6 = SpringsFromLine(
    Connection=wbedges_10,
    Stiffness=number_slider_92,
    Damping=10,
    RestLength=len_21,
    UpperCutoff=0,
    LowerCutoff=0,
    Plasticity=0)  # disabled
merge_16 = Merge(Data1=springs_6, Data2=meshpressure_10, Data3=meshpressure_9)  # -> flatten(Result); disabled

# ---- group: ALTERNATIVE MODELS / anchors
wbnaked_10 = WeaverbirdsNakedBoundary(MeshClosedPolylines=mesh_19)  # disabled
join_33 = JoinCurves(Curves=wbnaked_10, Preserve=False)  # disabled
wbvertices_6 = WeaverbirdsVerticesComponent(MeshClosedPolylinesGroup=mesh_19, Weld=True)  # disabled

wbnaked_11 = WeaverbirdsNakedBoundary(MeshClosedPolylines=mesh_3)  # disabled
join_34 = JoinCurves(Curves=wbnaked_11, Preserve=False)  # disabled
wbvertices_7 = WeaverbirdsVerticesComponent(MeshClosedPolylinesGroup=mesh_3, Weld=True)  # disabled

# ---- group: ALTERNATIVE MODELS (continued)
item_144 = ListItem(List=join_34, Index=0, Wrap=True)  # disabled
item_145 = ListItem(List=join_34, Index=1, Wrap=True)  # disabled
flipm_5 = FlipMesh(Mesh=item_67, VertexNormals=True, FaceNormals=True, FaceOrientation=True)  # disabled
flipm_6 = FlipMesh(Mesh=item_66, VertexNormals=True, FaceNormals=True, FaceOrientation=True)  # disabled
crv_cp_9 = CurveClosestPoint(Point=wbvertices_7, Curve=flatten(item_145))  # -> Point, Parameter, Distance; disabled
equals_7 = Equality(FirstNumber=crv_cp_9.Distance, SecondNumber=0)  # -> Equality, Inequality; disabled
sift_19 = SiftPattern(List=wbvertices_7, SiftPattern=equals_7.Equality)  # -> Output0, Output1; disabled
clean_15 = CleanTree(RemoveNulls=True, RemoveInvalid=True, RemoveEmpty=False, Tree=sift_11.Output1)  # disabled
dam = DataDam(DataA=geo_7, BufferDelay=10000000, BufferMode=0)  # disabled

# ---- group: ALTERNATIVE MODELS / anchors (continued)
crv_cp_10 = CurveClosestPoint(Point=wbvertices_7, Curve=flatten(item_144))  # -> Point, Parameter, Distance; disabled
equals_8 = Equality(FirstNumber=crv_cp_10.Distance, SecondNumber=0)  # -> Equality, Inequality; disabled
sift_20 = SiftPattern(List=wbvertices_7, SiftPattern=equals_8.Equality)  # -> Output0, Output1; disabled
geo_27 = Geometry([sift_20.Output1, sift_19.Output1])  # disabled

# ---- group: ALTERNATIVE MODELS / finest australian engine
button_4 = Button()  # disabled
kangaroo_5 = KangarooPhysics(ForceObjects=merge_7, AnchorPoints=flatten(geo_27), Settings=null, Geometry=mesh_3, SimulationReset=button_4)  # -> Out, Iterations, ParticlesOut, GeometryOut, KE; disabled
timer_5 = Timer(TimerInterval=20, Target=kangaroo_5)  # disabled
geo_28 = Geometry(flatten(kangaroo_5.GeometryOut))  # disabled

# ---- group: ALTERNATIVE MODELS / mesh to surface
wbfacepolys_4 = WeaverbirdsFacePolylines(Mesh=dam)  # -> flatten(Polygons); disabled
boundary_9 = BoundarySurfaces(Edges=wbfacepolys_4)  # -> flatten(Surfaces); disabled
join_35 = BrepJoin(Breps=boundary_9)  # -> Breps, Closed; disabled

# ---- group: ALTERNATIVE MODELS / trim and join pyras and kangaroo trias
trim_7 = TrimSolid(Shape=scale_2.Geometry, Cutters=extr)  # disabled
trim_8 = TrimSolid(Shape=mesh_5, Cutters=extr)  # disabled
join_36 = BrepJoin(Breps=flatten([trim_7, trim_8, join_35.Breps]))  # -> Breps, Closed; disabled

# ---- group: ALTERNATIVE MODELS (continued)
item_146 = ListItem(List=join_33, Index=0, Wrap=True)  # disabled
item_147 = ListItem(List=join_33, Index=1, Wrap=True)  # disabled
flipm_7 = FlipMesh(Mesh=item_143, VertexNormals=True, FaceNormals=True, FaceOrientation=True)  # disabled
flipm_8 = FlipMesh(Mesh=item_142, VertexNormals=True, FaceNormals=True, FaceOrientation=True)  # disabled
crv_cp_11 = CurveClosestPoint(Point=wbvertices_6, Curve=flatten(item_147))  # -> Point, Parameter, Distance; disabled
equals_9 = Equality(FirstNumber=crv_cp_11.Distance, SecondNumber=0)  # -> Equality, Inequality; disabled
sift_21 = SiftPattern(List=wbvertices_6, SiftPattern=equals_9.Equality)  # -> Output0, Output1; disabled

# ---- group: ALTERNATIVE MODELS / anchors (continued)
crv_cp_12 = CurveClosestPoint(Point=wbvertices_6, Curve=flatten(item_146))  # -> Point, Parameter, Distance; disabled
equals_10 = Equality(FirstNumber=crv_cp_12.Distance, SecondNumber=0)  # -> Equality, Inequality; disabled
sift_22 = SiftPattern(List=wbvertices_6, SiftPattern=equals_10.Equality)  # -> Output0, Output1; disabled
geo_29 = Geometry([sift_22.Output1, sift_21.Output1])  # disabled

# ---- group: ALTERNATIVE MODELS / finest australian engine
button_5 = Button()  # disabled
kangaroo_6 = KangarooPhysics(ForceObjects=merge_16, AnchorPoints=flatten(geo_29), Settings=null, Geometry=mesh_19, SimulationReset=button_5)  # -> Out, Iterations, ParticlesOut, GeometryOut, KE; disabled
timer_6 = Timer(TimerInterval=20, Target=kangaroo_6)  # disabled
geo_30 = Geometry(flatten(kangaroo_6.GeometryOut))  # disabled

# ---- group: ALTERNATIVE MODELS (continued)
dam_2 = DataDam(DataA=geo_30, BufferDelay=10000000, BufferMode=0)  # disabled

# ---- group: ALTERNATIVE MODELS / mesh to surface
wbfacepolys_5 = WeaverbirdsFacePolylines(Mesh=dam_2)  # -> flatten(Polygons); disabled
boundary_10 = BoundarySurfaces(Edges=wbfacepolys_5)  # -> flatten(Surfaces); disabled

# ---- group: ALTERNATIVE MODELS / assembly
join_37 = BrepJoin(Breps=flatten([boundary_10, debrep_46.Faces]))  # -> Breps, Closed; disabled
area_33 = Area(Geometry=join_37.Breps)  # -> Area, Centroid; disabled
geo_31 = Geometry(area_33.Centroid)  # disabled

# ---- group: initial non sorted orient
geo_32 = Geometry(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)  # disabled

# ---- group: top bottom list separation
Z_24 = UnitZ(Factor=1)  # disabled
neg_15 = Negative(Value=Z_24)  # disabled
move_29 = Move(Geometry=area_13.Centroid, Motion=neg_15)  # -> Geometry, Transform; disabled
ln_16 = Line(StartPoint=area_13.Centroid, EndPoint=move_29.Geometry)  # disabled

# ----
area_34 = Area(Geometry=geo_32)  # -> Area, Centroid; disabled
scale_22 = Scale(Geometry=geo_32, Center=area_34.Centroid, Factor=number_slider_55)  # -> Geometry, Transform; disabled

# ---- group: initial non sorted orient (continued)
mesh_20 = Mesh(scale_22.Geometry)  # disabled
orient_12 = Orient(Geometry=mesh_20, Source=PlaneXY(0, 0, 0), Target=pl_3pt)  # -> Geometry, Transform; disabled

# ---- group: top bottom list separation (continued)
mcx_2 = MeshCurve(Mesh=orient_12.Geometry, Curve=ln_16)  # -> Points, Faces; disabled
lng_4 = ListLength(List=mcx_2.Points)  # disabled
equals_11 = Equality(FirstNumber=lng_4, SecondNumber=0)  # -> flatten(Equality), flatten(Inequality); disabled
listdexs = ListIndices(List=orient_12.Geometry)  # disabled
sift_23 = SiftPattern(List=listdexs, SiftPattern=equals_11.Equality)  # -> Output0, Output1; disabled

# ---- group: top triangle centers
sift_24 = SiftPattern(List=polygon.Polygon, SiftPattern=equals_11.Equality)  # -> Output0, Output1; disabled
clean_16 = CleanTree(RemoveNulls=True, RemoveInvalid=True, RemoveEmpty=False, Tree=sift_24.Output1)  # -> flatten(Tree); disabled
area_35 = Area(Geometry=clean_16)  # -> Area, Centroid; disabled

# ---- group: top triangle corner point
number_slider_99 = Slider(1, range=0..2)  # disabled
explode_29 = Explode(Curve=clean_16, Recursive=True)  # -> Segments, Vertices; disabled
item_148 = ListItem(List=explode_29.Vertices, Index=number_slider_99, Wrap=True)  # -> flatten(Item); disabled

# ---- group: top triangle centers
sift_25 = SiftPattern(List=polygon.Polygon, SiftPattern=equals_11.Inequality)  # -> Output0, Output1; disabled
clean_17 = CleanTree(RemoveNulls=True, RemoveInvalid=True, RemoveEmpty=False, Tree=sift_25.Output1)  # -> flatten(Tree); disabled
area_36 = Area(Geometry=clean_17)  # -> Area, Centroid; disabled

# ---- group: top triangle corner point
number_slider_100 = Slider(1, range=0..2)  # disabled
explode_30 = Explode(Curve=clean_17, Recursive=True)  # -> Segments, Vertices; disabled
item_149 = ListItem(List=explode_30.Vertices, Index=number_slider_100, Wrap=True)  # -> flatten(Item); disabled

# ---- group: top oriented finished trias
clean_18 = CleanTree(RemoveNulls=True, RemoveInvalid=True, RemoveEmpty=False, Tree=sift_23.Output1)  # -> flatten(Tree); disabled
item_150 = ListItem(List=orient_12.Geometry, Index=clean_18, Wrap=True)  # disabled

clean_19 = CleanTree(RemoveNulls=True, RemoveInvalid=True, RemoveEmpty=False, Tree=sift_23.Output0)  # -> flatten(Tree); disabled
item_151 = ListItem(List=orient_12.Geometry, Index=clean_19, Wrap=True)  # disabled

# ---- group: finished triangle orientation point
sift_26 = SiftPattern(List=orient_7.Geometry, SiftPattern=equals_11.Equality)  # -> Output0, Output1; disabled
clean_20 = CleanTree(RemoveNulls=True, RemoveInvalid=True, RemoveEmpty=False, Tree=sift_26.Output1)  # -> flatten(Tree); disabled
vec2pt_18 = Vector2Pt(PointA=area_35.Centroid, PointB=clean_20, Unitize=False)  # -> Vector, Length; disabled

# ---- group: top triangle planes
sift_27 = SiftPattern(List=pl_3pt, SiftPattern=equals_11.Equality)  # -> Output0, Output1; disabled
clean_21 = CleanTree(RemoveNulls=True, RemoveInvalid=True, RemoveEmpty=False, Tree=sift_27.Output1)  # -> flatten(Tree); disabled

# ---- group: finished triangle orientation point
sift_28 = SiftPattern(List=orient_7.Geometry, SiftPattern=equals_11.Inequality)  # -> Output0, Output1; disabled
clean_22 = CleanTree(RemoveNulls=True, RemoveInvalid=True, RemoveEmpty=False, Tree=sift_28.Output1)  # -> flatten(Tree); disabled
vec2pt_19 = Vector2Pt(PointA=area_36.Centroid, PointB=clean_22, Unitize=False)  # -> Vector, Length; disabled

# ---- group: top triangle planes
sift_29 = SiftPattern(List=pl_3pt, SiftPattern=equals_11.Inequality)  # -> Output0, Output1; disabled
clean_23 = CleanTree(RemoveNulls=True, RemoveInvalid=True, RemoveEmpty=False, Tree=sift_29.Output1)  # -> flatten(Tree); disabled

# ---- group: rotation fix
vec2pt_20 = Vector2Pt(PointA=area_35.Centroid, PointB=item_148, Unitize=False)  # -> Vector, Length; disabled
angle_6 = Angle(VectorA=vec2pt_20.Vector, VectorB=vec2pt_18.Vector, Plane=clean_21)  # -> flatten(Angle), Reflex; disabled
neg_16 = Negative(Value=angle_6.Angle)  # disabled
rotate_5 = Rotate(Geometry=item_150, Angle=neg_16, Plane=clean_21)  # -> Geometry, Transform; disabled

vec2pt_21 = Vector2Pt(PointA=area_36.Centroid, PointB=item_149, Unitize=False)  # -> Vector, Length; disabled
angle_7 = Angle(VectorA=vec2pt_21.Vector, VectorB=vec2pt_19.Vector, Plane=clean_23)  # -> flatten(Angle), Reflex; disabled
neg_17 = Negative(Value=angle_7.Angle)  # disabled
rotate_6 = Rotate(Geometry=item_151, Angle=neg_17, Plane=clean_23)  # -> Geometry, Transform; disabled

# ----
pl_3 = PlaneNormal(Origin=clean_21, ZAxis=Vector(0, 0, 1))  # disabled
mirror_3 = Mirror(Geometry=rotate_6.Geometry, Plane=clean_23)  # -> Geometry, Transform; disabled
deplane_5 = DeconstructPlane(Plane=clean_21)  # -> Origin, XAxis, YAxis, ZAxis; disabled
deplane_6 = DeconstructPlane(Plane=clean_23)  # -> Origin, XAxis, YAxis, ZAxis; disabled
multiplication_15 = Multiplication(A=deplane_5.ZAxis, B=number_slider_56)  # disabled
multiplication_16 = Multiplication(A=deplane_6.ZAxis, B=number_slider_56)  # disabled
move_30 = Move(Geometry=rotate_5.Geometry, Motion=multiplication_15)  # -> Geometry, Transform; disabled
move_31 = Move(Geometry=mirror_3.Geometry, Motion=multiplication_16)  # -> Geometry, Transform; disabled

debrep_47 = DeconstructBrep(Brep=cap_5)  # -> Faces, Edges, Vertices; disabled
item_152 = ListItem(List=debrep_47.Faces, Index=0, Wrap=True)  # disabled
wbnaked_12 = WeaverbirdsNakedBoundary(MeshClosedPolylines=geo_22)  # disabled
item_153 = ListItem(List=wbnaked_12, Index=0, Wrap=True)  # disabled
srfsplit = SurfaceSplit(Surface=item_152, Curves=item_153)  # disabled
Z_25 = UnitZ(Factor=number_slider_6)  # disabled
Z_26 = UnitZ(Factor=number_slider_6)  # disabled
dam_3 = DataDam(DataA=geo_22, BufferDelay=10000000, BufferMode=0)  # disabled
neg_18 = Negative(Value=Z_25)  # disabled
replace_3 = ReplaceItems(List=debrep_47.Faces, Indices=[0, 1], Wrap=False)  # disabled
neg_19 = Negative(Value=Z_26)  # disabled
item_154 = ListItem(List=srfsplit, Index=0, Wrap=True)  # disabled
move_32 = Move(Geometry=item_153, Motion=neg_18)  # -> Geometry, Transform; disabled
clean_24 = CleanTree(RemoveNulls=True, RemoveInvalid=True, RemoveEmpty=False, Tree=replace_3)  # disabled
extr_6 = Extrude(Base=move_32.Geometry, Direction=Z_7)  # disabled
move_33 = Move(Geometry=item_154, Motion=neg_19)  # -> Geometry, Transform; disabled
debrep_48 = DeconstructBrep(Brep=extr_6)  # -> flatten(Faces), Edges, Vertices; disabled
number_slider_101 = Slider(12.896, range=0..19)  # disabled
number_slider_102 = Slider(12.85, range=0..15)  # disabled
Z_27 = UnitZ(Factor=number_slider_101)  # disabled
neg_20 = Negative(Value=Z_27)  # disabled
number_slider_103 = Slider(2, range=0..10)  # disabled
number_slider_104 = Slider(9, range=0..30)  # disabled
number_slider_105 = Slider(0.007, range=0..0.1)  # disabled
number_slider_106 = Slider(0.025, range=0..0.1)  # disabled
merge_17 = Merge(
    Data1=number_slider_106,
    Data2=number_slider_106,
    Data3=number_slider_106,
    Data4=number_slider_106,
    Data5=number_slider_106,
    Data6=number_slider_106,
    Data7=number_slider_106,
    Data8=number_slider_105,
    Data9=number_slider_105,
    Data10=number_slider_105,
    Data11=number_slider_105,
    Data12=number_slider_105,
    Data13=number_slider_105,
    Data14=number_slider_105,
    Data15=number_slider_105,
    Data16=number_slider_105,
    Data17=number_slider_105,
    Data18=number_slider_105,
    Data19=number_slider_105)  # disabled
panel_19 = Panel("""0
1
2
3
4
5
9
10
11
12
13
14
15
16
17
18
19
20
21""")  # disabled

# ---- group: mesh to surface
wbfacepolys_6 = WeaverbirdsFacePolylines(Mesh=dam_3)  # -> flatten(Polygons); disabled
boundary_11 = BoundarySurfaces(Edges=wbfacepolys_6)  # -> flatten(Surfaces); disabled

# ----
join_38 = BrepJoin(Breps=boundary_11)  # -> Breps, Closed; disabled
merge_18 = Merge(Data1=boundary_11, Data2=item_154, Data3=move_33.Geometry, Data4=clean_24, Data5=debrep_48.Faces)  # -> flatten(Result); disabled
clean_25 = CleanTree(RemoveNulls=True, RemoveInvalid=True, RemoveEmpty=False, Tree=merge_18)  # -> flatten(Tree); disabled
join_39 = BrepJoin(Breps=clean_25)  # -> Breps, Closed; disabled
area_37 = Area(Geometry=join_39.Breps)  # -> Area, Centroid; disabled
move_34 = Move(Geometry=area_37.Centroid, Motion=neg_20)  # -> Geometry, Transform; disabled
sph_3 = Sphere(Base=move_34.Geometry, Radius=number_slider_102)  # disabled
bbx = BrepBrep(BrepA=join_39.Breps, BrepB=sph_3)  # -> Curves, Points; disabled
trim_9 = TrimSolid(Shape=join_39.Breps, Cutters=sph_3)  # disabled
srfsplit_2 = SurfaceSplit(Surface=sph_3, Curves=bbx.Curves)  # disabled
debrep_49 = DeconstructBrep(Brep=flatten(trim_9))  # -> flatten(Faces), Edges, Vertices; disabled
item_155 = ListItem(List=srfsplit_2, Index=number_slider_103, Wrap=True)  # disabled
join_40 = BrepJoin(Breps=flatten([item_155, debrep_49.Faces]))  # -> Breps, Closed; disabled
debrep_50 = DeconstructBrep(Brep=join_40.Breps)  # -> Faces, Edges, Vertices; disabled
len_22 = Length(Curve=debrep_50.Edges)  # disabled
listdexs_2 = ListIndices(List=debrep_50.Edges)  # disabled
sort_7 = SortList(Keys=len_22, ValuesA=listdexs_2)  # -> Keys, reverse(ValuesA); disabled
item_156 = ListItem(List=sort_7.ValuesA, Index=number_slider_104, Wrap=True)  # disabled
item_157 = ListItem(List=sort_7.ValuesA, Index=panel_19, Wrap=True)  # -> flatten(Item); disabled
item_158 = ListItem(List=debrep_50.Edges, Index=item_156, Wrap=True)  # disabled
filedge_9 = FilletEdge(Shape=join_40.Breps, Blend=0, Metric=0, Edges=item_157, Radii=merge_17)  # disabled
panel_20 = Panel(item_157)  # disabled

# ---- group: ALTERNATIVE MODELS
debrep_51 = DeconstructBrep(Brep=cap_6)  # -> Faces, Edges, Vertices; disabled
item_159 = ListItem(List=debrep_51.Faces, Index=0, Wrap=True)  # disabled
wbnaked_13 = WeaverbirdsNakedBoundary(MeshClosedPolylines=geo_28)  # disabled
item_160 = ListItem(List=wbnaked_13, Index=0, Wrap=True)  # disabled
srfsplit_3 = SurfaceSplit(Surface=item_159, Curves=item_160)  # disabled
Z_28 = UnitZ(Factor=number_slider_4)  # disabled
Z_29 = UnitZ(Factor=number_slider_4)  # disabled
dam_4 = DataDam(DataA=geo_28, BufferDelay=10000000, BufferMode=0)  # disabled
neg_21 = Negative(Value=Z_28)  # disabled
replace_4 = ReplaceItems(List=debrep_51.Faces, Indices=[0, 1], Wrap=False)  # disabled
neg_22 = Negative(Value=Z_29)  # disabled
item_161 = ListItem(List=srfsplit_3, Index=0, Wrap=True)  # disabled
move_35 = Move(Geometry=item_160, Motion=neg_21)  # -> Geometry, Transform; disabled
clean_26 = CleanTree(RemoveNulls=True, RemoveInvalid=True, RemoveEmpty=False, Tree=replace_4)  # disabled
extr_7 = Extrude(Base=move_35.Geometry, Direction=Z_5)  # disabled
move_36 = Move(Geometry=item_161, Motion=neg_22)  # -> Geometry, Transform; disabled
debrep_52 = DeconstructBrep(Brep=extr_7)  # -> flatten(Faces), Edges, Vertices; disabled
number_slider_107 = Slider(12.896, range=0..19)  # disabled
number_slider_108 = Slider(12.85, range=0..15)  # disabled
Z_30 = UnitZ(Factor=number_slider_107)  # disabled
neg_23 = Negative(Value=Z_30)  # disabled
number_slider_109 = Slider(2, range=0..10)  # disabled
number_slider_110 = Slider(9, range=0..30)  # disabled
number_slider_111 = Slider(0.007, range=0..0.1)  # disabled
number_slider_112 = Slider(0.025, range=0..0.1)  # disabled
merge_19 = Merge(
    Data1=number_slider_112,
    Data2=number_slider_112,
    Data3=number_slider_112,
    Data4=number_slider_112,
    Data5=number_slider_112,
    Data6=number_slider_112,
    Data7=number_slider_112,
    Data8=number_slider_111,
    Data9=number_slider_111,
    Data10=number_slider_111,
    Data11=number_slider_111,
    Data12=number_slider_111,
    Data13=number_slider_111,
    Data14=number_slider_111,
    Data15=number_slider_111,
    Data16=number_slider_111,
    Data17=number_slider_111,
    Data18=number_slider_111,
    Data19=number_slider_111)  # disabled
panel_21 = Panel("""0
1
2
3
4
5
9
10
11
12
13
14
15
16
17
18
19
20
21""")  # disabled

# ---- group: ALTERNATIVE MODELS / mesh to surface
wbfacepolys_7 = WeaverbirdsFacePolylines(Mesh=dam_4)  # -> flatten(Polygons); disabled
boundary_12 = BoundarySurfaces(Edges=wbfacepolys_7)  # -> flatten(Surfaces); disabled

# ---- group: ALTERNATIVE MODELS (continued)
join_41 = BrepJoin(Breps=boundary_12)  # -> Breps, Closed; disabled
merge_20 = Merge(Data1=boundary_12, Data2=item_161, Data3=move_36.Geometry, Data4=clean_26, Data5=debrep_52.Faces)  # -> flatten(Result); disabled
clean_27 = CleanTree(RemoveNulls=True, RemoveInvalid=True, RemoveEmpty=False, Tree=merge_20)  # -> flatten(Tree); disabled
join_42 = BrepJoin(Breps=clean_27)  # -> Breps, Closed; disabled
area_38 = Area(Geometry=join_42.Breps)  # -> Area, Centroid; disabled
move_37 = Move(Geometry=area_38.Centroid, Motion=neg_23)  # -> Geometry, Transform; disabled
sph_4 = Sphere(Base=move_37.Geometry, Radius=number_slider_108)  # disabled
bbx_2 = BrepBrep(BrepA=join_42.Breps, BrepB=sph_4)  # -> Curves, Points; disabled
trim_10 = TrimSolid(Shape=join_42.Breps, Cutters=sph_4)  # disabled
srfsplit_4 = SurfaceSplit(Surface=sph_4, Curves=bbx_2.Curves)  # disabled
debrep_53 = DeconstructBrep(Brep=flatten(trim_10))  # -> flatten(Faces), Edges, Vertices; disabled
item_162 = ListItem(List=srfsplit_4, Index=number_slider_109, Wrap=True)  # disabled
join_43 = BrepJoin(Breps=flatten([item_162, debrep_53.Faces]))  # -> Breps, Closed; disabled
debrep_54 = DeconstructBrep(Brep=join_43.Breps)  # -> Faces, Edges, Vertices; disabled
len_23 = Length(Curve=debrep_54.Edges)  # disabled
listdexs_3 = ListIndices(List=debrep_54.Edges)  # disabled
sort_8 = SortList(Keys=len_23, ValuesA=listdexs_3)  # -> Keys, reverse(ValuesA); disabled
item_163 = ListItem(List=sort_8.ValuesA, Index=number_slider_110, Wrap=True)  # disabled
item_164 = ListItem(List=sort_8.ValuesA, Index=panel_21, Wrap=True)  # -> flatten(Item); disabled
item_165 = ListItem(List=debrep_54.Edges, Index=item_163, Wrap=True)  # disabled
filedge_10 = FilletEdge(Shape=join_43.Breps, Blend=0, Metric=0, Edges=item_164, Radii=merge_19)  # disabled
panel_22 = Panel(item_164)  # disabled

# ==== cluster Cluster
B = ClusterInput()
B_2 = ClusterInput()
debrep = DeconstructBrep(Brep=B)  # -> Faces, Edges, Vertices
debrep_2 = DeconstructBrep(Brep=B_2)  # -> Faces, Edges, Vertices
item = ListItem(List=debrep.Vertices, Index=0, Wrap=True)
item_2 = ListItem(List=debrep_2.Vertices, Index=1, Wrap=True)
item_3 = ListItem(List=debrep_2.Vertices, Index=2, Wrap=True)
item_4 = ListItem(List=debrep.Vertices, Index=2, Wrap=True)
item_5 = ListItem(List=debrep.Vertices, Index=1, Wrap=True)
item_6 = ListItem(List=debrep_2.Vertices, Index=0, Wrap=True)
srf4pt = _4PointSurface(CornerA=item, CornerB=item_2, CornerC=item_3)
srf4pt_2 = _4PointSurface(CornerA=item_2, CornerB=item, CornerC=item_4)
srf4pt_3 = _4PointSurface(CornerA=item_4, CornerB=item_2, CornerC=item_6)
srf4pt_4 = _4PointSurface(CornerA=item_6, CornerB=item_4, CornerC=item_5)
srf4pt_5 = _4PointSurface(CornerA=item_5, CornerB=item_6, CornerC=item_3)
srf4pt_6 = _4PointSurface(CornerA=item_3, CornerB=item, CornerC=item_5)
_1 = ClusterOutput(srf4pt)  # 1
_2 = ClusterOutput(srf4pt_2)  # 2
_3 = ClusterOutput(srf4pt_3)  # 3
_5 = ClusterOutput(srf4pt_5)  # 5
_4 = ClusterOutput(srf4pt_4)  # 4
_6 = ClusterOutput(srf4pt_6)  # 6

# ==== cluster MeshPressure: Applies pressure to a triangulated mesh
M = ClusterInput()
mcomp = Decompose(Mesh=M)  # -> Vertices, Faces, Colours, Normals
vertices = FaceVertices(Face=mcomp.Faces)  # -> CornerA, CornerB, CornerC, CornerD
item = ListItem(List=mcomp.Vertices, Index=vertices.CornerA, Wrap=False)
item_2 = ListItem(List=mcomp.Vertices, Index=vertices.CornerB, Wrap=False)
item_3 = ListItem(List=mcomp.Vertices, Index=vertices.CornerC, Wrap=False)
pressurelevel = ClusterInput()
pressure = Pressure(Point1=item, Point2=item_2, Point3=item_3, PressureLevel=pressurelevel)
P = ClusterOutput(pressure)
